# Grasshopper definition robotic_lacing.gh (Grasshopper 1.0.7)
# plug-ins: Pufferfish

# ----
# Attach a tool to the robot
# Tool
number_slider = Slider(100, range=0..100)
yz = YZPlane(Origin=Point(0, 0, 0))
cone = Cone(Base=yz, Radius=Slider(32, range=0..100), Length=number_slider)  # -> Cone, Tip
mesh = Mesh(cone.Cone)
mesh_2 = PythonScript(mesh=mesh)  # -> compas_mesh
# ---------- mesh_2: Python ----------
from compas.datastructures import Mesh
from compas_rhino.geometry import RhinoMesh

compas_mesh = RhinoMesh.from_guid(mesh).to_compas()
# ---------- end mesh_2 ----------
xy = XYPlane(Origin=Point(0, 0, 0))
python = GhPythonScript(tool_mesh=mesh_2, plane=xy)  # -> tool
# ---------- python: Python ----------
from compas_fab.robots import Tool
from compas_rhino.geometry import RhinoPlane

tool_frame = RhinoPlane.from_geometry(plane).to_compas()
tool = Tool(tool_mesh, tool_frame)
# ---------- end python ----------

# ---- group: ROS client
disconnect = Button()
connect = Button()
restart = Button()
ros = PythonScript(ip="127.0.0.1", restart=restart)  # -> out, ros_client
# ---------- ros: Python ----------
import sys
import time
import logging
import scriptcontext as sc

from compas_fab.backends import RosClient

from System import TimeSpan
from System.Threading import ManualResetEventSlim

LOGGER = logging.getLogger('roslibpy')

key = 'rosclient_%s' % str(ghenv.Component.InstanceGuid)
previous_client = sc.sticky.get(key, None)
if previous_client:
    previous_client.terminate()

ros_client = RosClient(ip, 9090)
sc.sticky[key] = ros_client

waitLock = ManualResetEventSlim(False)

ros_client.on_ready(lambda: waitLock.Set())

if not waitLock.Wait(TimeSpan.FromSeconds(5)):
    raise Exception('Unable to connect to ROS')

LOGGER.info('ROS connection opened')
# ---------- end ros ----------
connect_2 = PythonScript(ros_client=ros.ros_client, connect=connect, disconnect=disconnect)  # -> out, ros_client
# ---------- connect_2: Python ----------
import logging
from System import TimeSpan
from System.Threading import ManualResetEventSlim

LOGGER = logging.getLogger('roslibpy')

if connect:
    if not ros_client.is_connected:
        LOGGER.debug('Connecting...')
        waitLock = ManualResetEventSlim(False)
        ros_client.on_ready(lambda: waitLock.Set())
        ros_client.connect()

        if not waitLock.Wait(TimeSpan.FromSeconds(5)):
            raise Exception('Unable to connect to ROS')
        LOGGER.debug('Reconnected')

if disconnect:
    if ros_client.is_connected:
        ros_client.terminate()
        LOGGER.debug('Terminated')

print ros_client.is_connected
# ---------- end connect_2 ----------
is_connected = Panel(connect_2.out)

# ----
# Load robot directly from ROS
# (only working if connected and file_server launched)
units = ValueList({"m": 1, "cm": 100, "mm": 1000}, selected="mm")
units_2 = ValueList({"m": 1, "cm": 100, "mm": 1000}, selected="mm")
panel = Panel("Load example UR5 robot")
load = Button()
load_2 = Button()
create = PythonScript(scale_factor=units_2, load=load_2)  # -> robot
# ---------- create: Python ----------
import os
from scriptcontext import sticky as st

import compas
from compas_fab.robots.ur5 import Robot
from compas_fab.ghpython import RobotArtist

compas.PRECISION = '12f'

# store robot in component
guid = str(ghenv.Component.InstanceGuid)
robot_key = "robot_" + guid

if robot_key not in st:
    st[robot_key] = None

if load:
    robot = Robot(load_geometry=True)
    robot.artist = RobotArtist(robot.model)
    st[robot_key] = robot
    robot.scale(scale_factor)

robot = st[robot_key]
# ---------- end create ----------
python_2 = PythonScript(client=connect_2.ros_client, scale_factor=units, load=load)  # -> robot; inputs load: Boolean
# ---------- python_2: Python ----------
import os
from scriptcontext import sticky as st
import compas
from compas.robots import RobotModel
from compas_fab.backends import RosClient
from compas_fab.backends import RosFileServerLoader
from compas_fab.robots import Robot
from compas_fab.robots import RobotSemantics
from compas_fab.ghpython import RobotArtist

# Set high precision to import meshes defined in meters
if scale_factor == "m":
    compas.PRECISION = '24f'
else: compas.PRECISION = '4f'

# store robot in component
guid = str(ghenv.Component.InstanceGuid)
robot_key = "robot_" + guid

if robot_key not in st:
    st[robot_key] = None

if client and client.is_connected and load:

    # Load URDF from ROS
    loader = RosFileServerLoader(client)
    urdf = loader.load_urdf()
    srdf = loader.load_srdf()

    # Create robot model from URDF and load geometry
    model = RobotModel.from_urdf_string(urdf)
    model.load_geometry(loader)
    
    semantics = RobotSemantics.from_srdf_string(srdf, model)
    
    robot = Robot(model, semantics=semantics)
    robot.artist = RobotArtist(robot.model)
    robot.scale(scale_factor)
    st[robot_key] = robot

robot = st[robot_key]
if robot:
    robot.client = client
# ---------- end python_2 ----------
list = ValueList({"use from ROS": 0, "use example UR5": 1}, selected="use from ROS")
set = PythonScript(robot=create, client=connect_2.ros_client)  # -> robot
# ---------- set: Python ----------
if robot and client:
    robot.client = client
# ---------- end set ----------
filter = StreamFilter(Gate=list, Stream0=python_2, Stream1=set)
robot = Data(filter)

# ----
# Robot
reload = Button()

# ----
# Planning scene
# Pass collision objects to planning scene
# Select the links the object is allowed to touch
scene = PythonScript(robot=robot)  # -> scene
# ---------- scene: Python ----------
from scriptcontext import sticky as st

from compas_fab.robots import PlanningScene

# store scene in component
guid = str(ghenv.Component.InstanceGuid)
scene_key = "scene_" + guid

if scene_key not in st:
    st[scene_key] = None

if robot:
    st[scene_key] = PlanningScene(robot)

scene = st[scene_key]
# ---------- end scene ----------
idxs = Data([3, 4, 5, 6, 7])
py = PythonScript(robot=robot, idxs=idxs)  # -> touch_links; inputs idxs: list of Int32
# ---------- py: Python ----------
if robot:
    link_names = robot.get_link_names()
    touch_links = [link_names[i] for i in idxs]
# ---------- end py ----------
panel_2 = Panel(py)

panel_3 = Panel("Define an obstacle")
brep = Brep(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)
mesh_3 = Mesh(brep)
preview = CustomPreview(Geometry=brep, Shader=ColourSwatch(SwatchColor=RGB(255, 255, 255)))
mesh_4 = PythonScript(mesh=mesh_3)  # -> compas_mesh; same code as mesh_2
remove = Button()
scale = BooleanToggle(False)
add = Button()
collision = PythonScript(scene=scene, compas_mesh=mesh_4, scale=scale, id="box", add=add, remove=remove)  # -> out
# ---------- collision: Python ----------
from compas_fab.robots import CollisionMesh

cm = CollisionMesh(compas_mesh, id)

if scene:
    if add:
        scene.add_collision_mesh(cm, scale)
    if remove:
        scene.remove_collision_mesh(id)
# ---------- end collision ----------
panel_4 = Panel(collision)

# ----
# Attach an collision object
# Select link name to attach
number_slider_2 = Slider(6, range=0..7)
py_2 = PythonScript(robot=robot, idx=number_slider_2)  # -> link_name; inputs idx: Int32
# ---------- py_2: Python ----------
if robot:
    link_names = robot.get_link_names()
    link_name = link_names[idx]
# ---------- end py_2 ----------
panel_5 = Panel(py_2)
remove_2 = Button()
scale_2 = BooleanToggle(True)
add_2 = Button()
attached = PythonScript(scene=scene, compas_mesh=mesh_2, scale=scale_2, id="gripper", link_name=py_2, touch_links=py, add=add_2, remove=remove_2)  # -> acm, out; inputs touch_links: list
# ---------- attached: Python ----------
from compas_fab.robots import CollisionMesh
from compas_fab.robots import AttachedCollisionMesh

cm = CollisionMesh(compas_mesh, id)
acm = AttachedCollisionMesh(cm, link_name, touch_links)

if scene:
    if add:
        scene.add_attached_collision_mesh(acm, scale)
    if remove:
        scene.remove_attached_collision_mesh(id)
        scene.remove_collision_mesh(id)
# ---------- end attached ----------

py_3 = PythonScript(reload=reload)
# ---------- py_3: Python ----------
from compas_rhino.utilities.misc import get_tolerance
from compas_rhino.utilities.misc import unload_modules

from compas_ghpython import unload_modules
unload_modules("compas")
unload_modules("compas_fab")
unload_modules("roslibpy")
# ---------- end py_3 ----------
# Based on RFL template
# by @kathrind, @stefanap
# ----
# A REVISED TEMPLATE FOR THE CREATE LAB, PRINCETON UNIVERSITY
# ----
# Requires compas (xx.xx or later), compas_fab, abb_communication libraries
unload_abb_communication_lib = Button()
py_4 = PythonScript(unload=unload_abb_communication_lib)
# ---------- py_4: Python ----------
from abb_communication.useful import unload_rfl_lib

if unload:
    unload_rfl_lib()
# ---------- end py_4 ----------

# ----
# Info
button = Button()
info = PythonScript(robot=robot, tool=python, attach_tool=button, detach_tool=Button())  # -> out, main_group_name
# ---------- info: Python ----------
from compas_fab.robots import Tool

if robot:
    
    # attach tool
    if attach_tool:
        robot.attach_tool(tool)
        
    # detatch tool
    if detach_tool:
        robot.detach_tool()
    
    robot.info()
    main_group_name = robot.main_group_name
# ---------- end info ----------
panel_6 = Panel(info.out)

# ----
# Combine single/multiple planes into one function
# Value list choose linear/joint
panel_7 = Panel("What is relative/absolute?")

# ----
# Robot and tool
# IP
# Robot
# Tool
init = Button()
list_2 = ValueList({"127.0.0.1", "127.0.0.2", "127.0.0.3", "192.168.125.1", "192.168.0.21", "192.168.0.11"}, selected="127.0.0.2")
list_3 = ValueList({"IRB 120": 0, "IRB 4600": 1}, selected="IRB 120")
# Communication
list_4 = ValueList({"no tool": 0, "lacing tool": 1}, selected="lacing tool")
cluster = Cluster_2(init=init, data=list_2, G=list_3)
tool = Tool(init=init, int=list_4)
cluster_2 = Cluster(init=init)
set_tool_and_base = PythonScript(robot=cluster, tool=tool, gantry=cluster_2)  # -> out, robot
# ---------- set_tool_and_base: Python ----------
from scriptcontext import sticky as st

#apply tool and gantry to robot

if tool:
    robot.set_tool(tool)
    tool_visual = tool.visual
    
st["robot_1"] = robot

#if gantry:
    #robot.set_gantry(gantry)
    #gantry_geo = gantry.geo
    #robot.set_robot_origin(base_plane1, 1)
    #set_robot_origin_with_measured_base(self, base_plane):
# ---------- end set_tool_and_base ----------

python_3 = PythonScript()  # -> out, network_vertices, network_edges, point_grid, list_frames
# ---------- python_3: Python ----------
from compas.datastructures.network import Network
from compas_ghpython.artists import NetworkArtist, MeshArtist
from compas.datastructures.mesh import Mesh
import Rhino.Geometry as rg

pts_all = []

# generate a nested list of points
for i in range(3):
    pts_all.append([])
    for j in range(3):
        pts_all[i].append([])
        for k in range(3):
            pt = (i*100 + 300, j*100 - 150, k*100 + 150)
            pts_all[i][j].append(pt)

# generate an empty Network instance
point_grid = Network()

# add vertices and edges to Network
for i, pt_i in enumerate(pts_all):
    for j, pt_j in enumerate(pt_i):
        for k, pt_k in enumerate(pt_j):
            point_grid.add_vertex(key=str(i)+str(j)+str(k), x=pt_k[0], y=pt_k[1], z=pt_k[2])
            
            if k < len(pt_j)-1:
                point_grid.add_edge(str(i)+str(j)+str(k), str(i)+str(j)+str(k+1))
            if j < len(pt_i)-1:
                point_grid.add_edge(str(i)+str(j)+str(k), str(i)+str(j+1)+str(k))
            if i < len(pts_all)-1:
                point_grid.add_edge(str(i)+str(j)+str(k), str(i+1)+str(j)+str(k))

artist = NetworkArtist(point_grid)
#network_vertices = artist.draw_vertices()
#network_edges = artist.draw_edges()

list_frames = []

for vert in point_grid.vertex:
    
    pt_dict = point_grid.vertex[vert]
    pt = (pt_dict["x"], pt_dict["y"], pt_dict["z"])
    pt_dict.update({"robot_frame": (pt, (1,0,0), (0,-1,0))})
    
    list_frames.append(pt_dict["robot_frame"])
# ---------- end python_3 ----------
r_off = Button()

refresh_text_window = Button()
reset_robot = Button()
r_on = Button()
if_connection = PythonScript(connect_robot=r_on, close_robot=r_off, refresh=refresh_text_window, reset_robot=reset_robot)  # -> out; inputs connect_robot: Boolean, close_robot: Boolean, refresh: Boolean
# ---------- if_connection: Python ----------
#import Rhino.Geometry as rg
from scriptcontext import sticky as st
from abb_communication.clients.rfl_robot.communication.messages.clientstates import *

robot = st["robot_1"]

# connect
if connect_robot == True:
    if robot.comm.running == False:
        robot.comm.start()

# disconnect    
if close_robot == True:
    if robot.comm.running == True:
        robot.comm.close_sockets()
        robot.comm.cmd_counter_to_client = 0
        robot.comm.cmd_exec_counter_from_client = 0
        robot.comm.publish_state(1)

if reset_robot:
    robot.comm.close_sockets()
    robot.comm.cmd_counter_to_client = 0
    robot.comm.cmd_exec_counter_from_client = 0
    robot.comm.publish_state(1)
    try:
        robot.comm.start()
    except:
        print "CONNECTION TO ABB FAILED"

robot_conncection_state = "online" if robot.comm.running else "offline"
print "ABB CONNECTION STATE:", robot_conncection_state
print "ABB STATE: ", client_states_str_array[robot.comm.state]
print "Sent commands to ABB: ",  robot.comm.get_cmd_counter()
print "Executed commands from ABB: ",  robot.comm.cmd_exec_counter_from_client
# ---------- end if_connection ----------
panel_8 = Panel(if_connection)

work_object = ValueList({"wobj_0": 0, "wobj_common": 1, "wobj_base": 2, "wobj_stu_pick": 3, "wobj_stu_base": 4}, selected="wobj_0")
# Send poses
# Put this inside the script
robot_number = Slider(1, range=1..2)
# Settings
speed = Slider(100, range=0..100)
zone = Slider(10, range=0..100)
if_sender = PythonScript(init=r_on, speed=speed, zone=zone, wobj=work_object)  # -> out, a
# ---------- if_sender: Python ----------
from scriptcontext import sticky as st

robot = st["robot_1"]

if robot:    

    tool_nb = st["tool_nb"]
    
    robot.comm.set_speed(speed,zone)
    robot.comm.set_tool(tool_nb)
    robot.comm.set_wobj(wobj)

    if robot.comm.running:
        print "ROBOT IS ONLINE"
    else:
        print "ROBOT IS OFFLINE"
# ---------- end if_sender ----------
panel_9 = Panel(if_sender.out)

python_4 = PythonScript(frames=python_3.list_frames)  # -> out, planes; inputs frames: list
# ---------- python_4: Python ----------
import Rhino.Geometry as rg

planes = []
for frame in frames:
    origin = rg.Point3d(frame[0][0], frame[0][1], frame[0][2])
    x_vec = rg.Vector3d(frame[1][0], frame[1][1], frame[1][2])
    y_vec = rg.Vector3d(frame[2][0], frame[2][1], frame[2][2])
    planes.append(rg.Plane(origin, x_vec, y_vec))
# ---------- end python_4 ----------
pln = Plane(python_4.planes)

# ----
# Robot number
stepsize = Slider(-10, range=-180..180)
stepsize_2 = Slider(-200, range=-14000..14000)
send_current_robot_tool_pose_joint_multi = Button()  # "send current robot tool pose joint multiple"
send_current_robot_tool_pose_multiple = Button()
# Put this inside the script
number_slider_3 = Slider(1, range=1..4)
send_current_robot_tool_pose_joint = Button()
send_current_robot_tool_pose = Button()
send_robot_joints_absolute = Button()
axis_1_9 = Slider(2, range=1..9)
expression = Expression(x=axis_1_9, y=stepsize, z=stepsize_2, Expression="If(x < 7, y, z)")
send_robot_joints_relative = Button()
int = Integer(expression)
if_sender_2 = PythonScript(
    init=init,
    list_planes=pln,
    send_current_tool_pose=send_current_robot_tool_pose,
    send_current_tool_poses_mult=send_current_robot_tool_pose_multiple,
    sent_current_tool_pose_joints=send_current_robot_tool_pose_joint,
    send_current_tool_poses_joints_mult=send_current_robot_tool_pose_joint_multi,
    send_joints_absolute=send_robot_joints_absolute,
    send_joints_rel=simplify(send_robot_joints_relative),
    joint=axis_1_9,
    relative_angle=int,
    rob_num=number_slider_3)  # -> out, a; inputs list_planes: list, list_track_values: list, send_current_tool_pose: Boolean, joints_abb: list, joint: Int32, rob_num: Int32
# ---------- if_sender_2: Python ----------
from scriptcontext import sticky as st
#from abb_communication.clients.rfl_robot.communication.messages.messagetypes import *
#import Rhino.Geometry as rg
#from abb_communication.geometry import Frame
#import math as m
#from threading import Thread
#import time

ext_axes = [0,0,0]
list_ext_axes = [[0,0,0] for t_v in list_track_values]

robot = st["robot_1"]

if robot:        
    if robot.comm.running:
        print "ROBOT IS ONLINE"
        if send_current_tool_pose:
            robot.float_arbitrary = int(rob_num)
            print "axes_ext", ext_axes
            test = robot.comm.send_pose_cartesian(plane, ext_axes)
            print test
        if sent_current_tool_pose_joints:
            robot.float_arbitrary = int(rob_num)
            test = robot.comm.send_pose_cartesian_joints(plane, ext_axes)
            print test
        if send_current_tool_poses_mult:
            print list_planes
            print list_ext_axes
            robot.float_arbitrary = int(rob_num)
            test = robot.comm.send_pose_cartesian_list(list_planes, list_ext_axes)
            print test
        if send_current_tool_poses_joints_mult:
            robot.float_arbitrary = int(num_rob)
            robot.comm.send_pose_cartesian_joints_list(list_planes, list_ext_axes)
            
        if send_joints_rel:
            robot.float_arbitrary = int(rob_num)
            print "joints rel"
            joints = [0,0,0,0,0,0,0,0,0]
            joints[joint-1] = relative_angle
            test = robot.comm.send_axes_relative(joints, int_arr = None)
            print test
            
        if send_joints_absolute:
            robot.float_arbitrary = int(rob_num)
            #joints_abb_list = [float(x) for x in joints_abb.split()]
            joints_abb_list = [float(x) for x in joints_abb]
            robot.comm.send_axes_absolute(joints_abb_list, int_arr = None)
        
    else:
        print "ROBOT IS OFFLINE"
# ---------- end if_sender_2 ----------

item = ListItem(List=pln, Index=Slider(18, range=0..27), Wrap=True)
multiple = BooleanToggle(False)
use_tool = BooleanToggle(False)
send_pose = Button()

# ----
# Planes in WCS (Rhino)
number_slider_4 = Slider(16, range=0..100)
crv = Curve(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)
pframes = PerpFrames(Curve=crv, Count=number_slider_4, Align=True)  # -> Frames, Parameters
reorient_planes = PythonScript(F=pframes.Frames)  # -> out, F; inputs F: list of Plane
# ---------- reorient_planes: Python ----------
import Rhino.Geometry as rg
import math as m



[f.Rotate(m.radians(90), f.XAxis, f.Origin) for f in F]
[f.Rotate(m.radians(90), f.ZAxis, f.Origin) for f in F]
# ---------- end reorient_planes ----------

list_5 = ValueList({"Linear": move_linear, "Joint": move_joint}, selected="Linear")
python_5 = PythonScript(send=send_pose, rob_num=number_slider_3, plane=item)  # -> out, a; inputs rob_num: Int32, plane: Plane, list_planes: list of Plane
# ---------- python_5: Python ----------
#from abb_communication.clients.rfl_robot.communication.messages.messagetypes import *
##import Rhino.Geometry as rg
#from abb_communication.geometry import Frame
from scriptcontext import sticky as st
#import math as m
#from threading import Thread
#import time
    
ext_axes = [0,0,0]
list_ext_axes = [[0,0,0], [0,0,0]]
    
robot = st["robot_1"]
    
if robot:
    if robot.comm.running:
        print "ROBOT IS ONLINE"
        
        if send:
            
            robot.float_arbitrary = int(rob_num)
            #======================================================================================
            #====================== insert robot commands here ====================================
            #======================================================================================
            
            #if move_type == "move_linear":
            #    pass
            #elif move_type == "move_joint":
            #    pass
                
            #for example:
                
            #robot.comm.send_set_speed(speed_tcp, speed_track)
            #robot.comm.send_pose_cartesian(plane, ext_axes) #ext_axes is a list of 3 values
            robot.comm.send_pose_cartesian_joints(plane, ext_axes)
            #robot.comm.send_pose_cartesian_list(list_planes, list_ext_axes)
            #robot.comm.send_pose_cartesian_joints_list(list_planes, list_ext_axes)
            #robot.comm.send_axes_relative(joints, int_arr = None)
            #robot.comm.send_axes_absolute(joints_abb_list, int_arr = None)
            #robot.comm.wait_for_state_ready(wait_time)
            
    else:
        print "ROBOT IS OFFLINE"
# ---------- end python_5 ----------

# ----
# Input
panel_10 = Panel("End plane")
pt = Point(Point(19.08741002, 17.85114736, 20.74489064))
panel_11 = Panel("Start plane")
pt_2 = Point(Point(405.8192657, 118.5077887, 711.757851))
py_5 = GhPythonScript(pt=pt)  # -> pln
# ---------- py_5: Python ----------
import Rhino.Geometry as rg

pln = rg.Plane(pt, -rg.Vector3d.ZAxis)
# ---------- end py_5 ----------
py_6 = GhPythonScript(pt=pt_2)  # -> pln; same code as py_5
start_plane = Plane(py_6)
end_plane = Plane(py_5)

pl = ConstructPlane(Origin=pt_2, XAxis=Vector(1, 0, 0), YAxis=Vector(0, 1, 0))
deplane = DeconstructPlane(Plane=pl)  # -> Origin, XAxis, YAxis, ZAxis
amp = Amplitude(Vector=deplane.ZAxis, Amplitude=expr("-x", number_slider))
pt_3 = Point(Point(83.35698744, -432.7877872, 595.1747827))

timer = Timer(TimerInterval=20, Target=get_joints)  # disabled
get_joints = PythonScript(get_joint_vals=Toggle(True), init=Button())  # -> out, rob_values, gantry_values
# ---------- get_joints: Python ----------
import ghpythonlib.components as ghcomp
import Rhino.Geometry as rg
import math as m
from copy import copy, deepcopy
from scriptcontext import sticky as st
robot = st["robot_1"] 


if robot.comm.ghenv == None:
    robot.comm.ghenv = ghenv

if get_joint_vals:
    
    if robot.comm.running:
        #joint_values =  robot.comm.get_current_pose_joint()
        #print "Robot Joint Pose:  [%.3f, %.3f, %.3f, %.3f, %.3f, %.3f] " % (m.degrees(joint_values[0]), m.degrees(joint_values[1]), m.degrees(joint_values[2]), m.degrees(joint_values[3]), m.degrees(joint_values[4]), m.degrees(joint_values[5]))
        #joint_values = [m.degrees(p) for p in joint_values]

        #pose_values = robot.comm.get_current_pose_cartesian()
        #print "Robot Pose:  [%.3f, %.3f, %.3f, %.3f, %.3f, %.3f, %.3f] " % tuple(pose_values)
        
        
        
        posej =  robot.comm.get_current_pose_joint()
        #print posej
        joint_values_1 = (m.degrees(posej[0]), m.degrees(posej[1]), m.degrees(posej[2]), m.degrees(posej[3]), m.degrees(posej[4]), m.degrees(posej[5]), posej[6], posej[7], posej[8])
        rob_values_1 = joint_values_1[0:6]
        gantry_values_1 = joint_values_1[6:9]
        joint_values_2 = (m.degrees(posej[9]), m.degrees(posej[10]), m.degrees(posej[11]), m.degrees(posej[12]), m.degrees(posej[13]), m.degrees(posej[14]), posej[15], posej[16], posej[17])
        rob_values_2 = joint_values_2[0:6]
        gantry_values_2 = joint_values_2[6:9]
        joint_values_3 = (m.degrees(posej[18]), m.degrees(posej[19]), m.degrees(posej[20]), m.degrees(posej[21]), m.degrees(posej[22]), m.degrees(posej[23]), posej[24], posej[25], posej[26])
        rob_values_3 = joint_values_3[0:6]
        gantry_values_3 = joint_values_3[6:9]
        joint_values_4 = (m.degrees(posej[27]), m.degrees(posej[28]), m.degrees(posej[29]), m.degrees(posej[30]), m.degrees(posej[31]), m.degrees(posej[32]), posej[33], posej[34], posej[35])
        rob_values_4 = joint_values_4[0:6]
        gantry_values_4 = joint_values_4[6:9]
        rob_values = [rob_values_1, rob_values_2, rob_values_3, rob_values_4]
        gantry_values = [gantry_values_1, gantry_values_2, gantry_values_3, gantry_values_4]
        
        #print posej
        print "Robot 1 Joint Pose:  [%.6f, %.6f, %.6f, %.6f, %.6f, %.6f, %.6f, %.6f, %.6f] " % (m.degrees(posej[0]), m.degrees(posej[1]), m.degrees(posej[2]), m.degrees(posej[3]), m.degrees(posej[4]), m.degrees(posej[5]), posej[6], posej[7], posej[8])
        print "Robot 2 Joint Pose:  [%.6f, %.6f, %.6f, %.6f, %.6f, %.6f, %.6f, %.6f, %.6f] " % (m.degrees(posej[9]), m.degrees(posej[10]), m.degrees(posej[11]), m.degrees(posej[12]), m.degrees(posej[13]), m.degrees(posej[14]), posej[15], posej[16], posej[17])
        print "Robot 3 Joint Pose:  [%.6f, %.6f, %.6f, %.6f, %.6f, %.6f, %.6f, %.6f, %.6f] " % (m.degrees(posej[18]), m.degrees(posej[19]), m.degrees(posej[20]), m.degrees(posej[21]), m.degrees(posej[22]), m.degrees(posej[23]), posej[24], posej[25], posej[26])
        print "Robot 4 Joint Pose:  [%.6f, %.6f, %.6f, %.6f, %.6f, %.6f, %.6f, %.6f, %.6f] " % (m.degrees(posej[27]), m.degrees(posej[28]), m.degrees(posej[29]), m.degrees(posej[30]), m.degrees(posej[31]), m.degrees(posej[32]), posej[33], posej[34], posej[35])
        
        posec =  robot.comm.get_current_pose_cartesian()
        pose_values = (posec[0], posec[1], posec[2], posec[3], posec[4], posec[5], posec[6], posec[7], posec[8], posec[9])
        #print posec
        print "Robot 1 Cartesian Pose:  [%.6f, %.6f, %.6f, %.6f, %.6f, %.6f, %.6f, %.6f, %.6f, %.6f] " % (posec[0], posec[1], posec[2], posec[3], posec[4], posec[5], posec[6], posec[7], posec[8], posec[9])
        print "Robot 2 Cartesian Pose:  [%.6f, %.6f, %.6f, %.6f, %.6f, %.6f, %.6f, %.6f, %.6f, %.6f] " % (posec[10], posec[11], posec[12], posec[13], posec[14], posec[15], posec[16], posec[17], posec[18], posec[19])
        print "Robot 3 Cartesian Pose:  [%.6f, %.6f, %.6f, %.6f, %.6f, %.6f, %.6f, %.6f, %.6f, %.6f] " % (posec[20], posec[21], posec[22], posec[23], posec[24], posec[25], posec[26], posec[27], posec[28], posec[29])
        print "Robot 4 Cartesian Pose:  [%.6f, %.6f, %.6f, %.6f, %.6f, %.6f, %.6f, %.6f, %.6f, %.6f] " % (posec[30], posec[31], posec[32], posec[33], posec[34], posec[35], posec[36], posec[37], posec[38], posec[39])
    else:
        print "ROBOT IS OFFLINE"
        joint_values_1 = [0,0,0,0,0,0,3000,-3000,-3000]
        rob_values_1 = joint_values_1[0:6]
        gantry_values_1 = joint_values_1[6:9]
        joint_values_2 = [0,0,0,0,0,0,3000,-8000,-3000]
        rob_values_2 = joint_values_2[0:6]
        gantry_values_2 = joint_values_2[6:9]
        joint_values_3 = [0,0,0,0,0,0,8000,-3000,-3000]
        rob_values_3 = joint_values_3[0:6]
        gantry_values_3 = joint_values_3[6:9]
        joint_values_4 = [0,0,0,0,0,0,8000,-8000,-3000]
        rob_values_4 = joint_values_4[0:6]
        gantry_values_4 = joint_values_4[6:9]
        rob_values = [rob_values_1, rob_values_2, rob_values_3, rob_values_4]
        gantry_values = [gantry_values_1, gantry_values_2, gantry_values_3, gantry_values_4]
        pose_values = [0,0,0,0,0,0,0,0,0,0]
        #robot.comm.current_joint_values = [0,0,0,0,0,0,0,0,0]
        #robot.comm.current_tool0_pose = [0,0,0,0,0,0,0,0,0,0]
        
#joint_values = robot.comm.current_joint_values
#pose_values = robot.comm.current_tool0_pose

print "gantry_values", gantry_values
print "rob_values", rob_values
#print "pose_values", pose_values

"""
print "Current joints:  [%.3f, %.3f, %.3f, %.3f, %.3f, %.3f] " % tuple(joint_values)
print "Current task_pose:  [%.3f, %.3f, %.3f, %.3f, %.3f, %.3f, %.3f] " % tuple(pose_values)"""
# ---------- end get_joints ----------
panel_12 = Panel(get_joints.out)

front = Slider(0, range=-90..90)
back = Slider(0, range=-90..90)
gantry_y = Slider(0, range=0..12200)  # disabled
gantry_x = Slider(0, range=0..37200)  # disabled
gantry_z = Slider(1300, range=1300..4600)  # disabled
a2 = Slider(101.48, range=-360..360)
a5 = Slider(66.373, range=-360..360)
a1 = Slider(-8.812, range=-360..360)
a4 = Slider(-5.924, range=-360..360)
_46 = Slider(79.86, range=-360..360)
a3 = Slider(-69.915, range=-360..360)
python_6 = PythonScript(x=gantry_x, y=gantry_y, z=gantry_z)  # -> out, a; disabled
# ---------- python_6: Python ----------
a = []

a.append(x)
a.append(y*(-1))
a.append(z*(-1))
# ---------- end python_6 ----------
mm_tool_front_back = Data([front, back])
abb_a1_a6 = Data([a1, a2, a3, a4, a5, _46])

pl_2 = ConstructPlane(Origin=deplane.Origin, XAxis=deplane.ZAxis, YAxis=deplane.YAxis)
move = Move(Geometry=pl_2, Motion=amp)  # -> Geometry, Transform
panel_13 = Panel(python_5.out)
pln_2 = Plane(reorient_planes.F)

# ---- group: forward kinematics
a1_2 = Slider(0, range=-360..360)
a3_2 = Slider(0, range=-360..360)
a4_2 = Slider(0, range=-360..360)
a5_2 = Slider(0, range=-360..360)
a6 = Slider(0, range=-360..360)
a2_2 = Slider(0, range=-360..360)
set_joint_positions = BooleanToggle(False)
jp = GhPythonScript()  # -> joint_positions
# ---------- jp: Python ----------
import math
joint_positions = [-3.136, -0.328, -1.218, 3.129, 0.852, 0.008]
joint_positions = [0] * 6
print joint_positions
# ---------- end jp ----------
forward_kinematics = PythonScript(
    robot=robot,
    set_joint_positions=set_joint_positions,
    joint_positions=jp,
    a1=a1_2,
    a2=a2_2,
    a3=a3_2,
    a4=a4_2,
    a5=a5_2,
    a6=a6)  # -> full_configuration; inputs joint_positions: list
# ---------- forward_kinematics: Python ----------
import math
import Grasshopper
from compas.robots import Joint
from compas_fab.robots import Configuration

if set_joint_positions:

    j = 0
    for i in range(ghenv.Component.Params.Input.Count):
        nslider = ghenv.Component.Params.Input[i].Sources[0]
        if nslider.GetType() == Grasshopper.Kernel.Special.GH_NumberSlider:
            nslider.TrySetSliderValue(math.degrees(joint_positions[j]))
            j += 1

if robot:
    joint_positions = [a1, a2, a3, a4, a5, a6]
    joint_types = robot.get_configurable_joint_types()
    for i, joint_type in enumerate(joint_types):
        if joint_type == Joint.REVOLUTE:
            joint_positions[i] = math.radians(joint_positions[i])
    full_configuration = Configuration(joint_positions, joint_types)
# ---------- end forward_kinematics ----------

# ---- group: Input
list_6 = ValueList({"0 forward, angles from sliders": 0, "1 forward, angles from online robot": 1}, selected="1 forward, angles from online robot")
python_7 = PythonScript(j1=abb_a1_a6)  # -> out, a; inputs j1: list, j2: list, j3: list, j4: list
# ---------- python_7: Python ----------
a = []

a.append(j1)
a.append(j2)
a.append(j3)
a.append(j4)

print a
# ---------- end python_7 ----------
filter_2 = StreamFilter(Gate=list_6, Stream0=mm_tool_front_back, Stream1=mm_tool_front_back)
filter_3 = StreamFilter(Gate=list_6, Stream0=python_7.a, Stream1=get_joints.rob_values)
xy_2 = XYPlane(Origin=Point(0, 0, 0))
ifrep = PythonScript(robot_origin_plane_1=xy_2, joint_values=filter_3, tool_joint_values=filter_2, show_coll_geo=Toggle(True))  # -> base_geo_1, base_geo_4, link_geo_1, tool_geo_1, tool0_plane_1; inputs robot_origin_plane_1: Plane, joint_values: list, tool_joint_values: list, show_coll_geo: Boolean
# ---------- ifrep: Python ----------
from scriptcontext import sticky as st

print joint_values

robot = st["robot_1"]

if robot.tool:
    geo_init = robot.tool.visual
robot.set_robot_origin(robot_origin_plane_1)
#robot.set_robot_origin(robot_origin_plane_4)

#base_geo_1, link_geo_1, tool_geo_1 = robot.get_geo_with_rotated_joints_in_world_with_tool_rot(joint_values[0], tool_joint_values, 1, extended = extended)
#base_geo_2, link_geo_2, tool_geo_2 = robot.get_geo_with_rotated_joints_in_world_with_tool_rot(joint_values[1], tool_joint_values, 2, extended = extended)
#base_geo_3, link_geo_3, tool_geo_3 = robot.get_geo_with_rotated_joints_in_world_with_tool_rot(joint_values[2], tool_joint_values, 3, extended = extended)
#base_geo_4, link_geo_4, tool_geo_4 = robot.get_geo_with_rotated_joints_in_world_with_tool_rot(joint_values[3], tool_joint_values, 4, extended = extended)

if robot.tool:
    base_geo_1, link_geo_1, tool_geo_1 = robot.get_geo_with_rotated_joints_in_world(joint_values[0])
else:
    base_geo_1, link_geo_1 = robot.get_geo_with_rotated_joints_in_world(joint_values[0])
#base_geo_4, link_geo_4, tool_geo_4 = robot.get_geo_with_rotated_joints_in_world(joint_values[3])

if robot.tool:
   # tool_geo_colors = robot.tool.colors
    tool0_plane_1 = robot.get_tool0_plane_from_joint_values_world(joint_values[0])
#tool0_plane_4 = robot.get_tool0_plane_from_joint_values_world(joint_values[3], 4)

#gantry_geo_3 = robot.gantry.get_transformed_geo(robot_origin_plane_3)
#gantry_geo_4 = robot.gantry.get_transformed_geo(robot_origin_plane_4, 4)

#if show_coll_geo == False:
#    tool_geo.pop(-1)
    
robot_geo_colors = robot.colors_links + robot.colors_base
# ---------- end ifrep ----------
preview_2 = CustomPreview(
    Geometry=[ifrep.link_geo_1, ifrep.base_geo_1, ifrep.base_geo_4],
    Shader={diffuse=RGB(255, 105, 180), emission=RGB(76, 32, 54), shine=0.5, specular=RGB(255, 255, 255), transparency=0})
preview_3 = CustomPreview(
    Geometry=ifrep.tool_geo_1,
    Shader={diffuse=RGB(255, 105, 180), emission=RGB(76, 32, 54), shine=0.5, specular=RGB(255, 255, 255), transparency=0})
pln_3 = Plane(ifrep.tool0_plane_1)

# ----
# Calculation planes and poses
ur_poses = PythonScript(planes_tool_WCS=reorient_planes.F, idx=Slider(14, range=0..30), init=Button())  # -> out, origin_plane, planes_tool_WCS, planes_tool_RCS, planes_tool0_RCS, poses_tool_RCS, plane_at_idx_WCS, tool_geo_on_plane_at_idx_WCS, tool_geo_colors; inputs planes_tool_WCS: list of Plane, idx: Int32
# ---------- ur_poses: Python ----------
import Rhino.Geometry as rg
import ghpythonlib.components as ghcomp

from scriptcontext import sticky as st

robot = st["robot_1"]

origin_plane_1 = robot.origin_plane
#3origin_plane_2 = robot.origin_plane_2

planes_tool_RCS_1 = [robot.get_tool_plane_in_RCS(tp_WCS) for tp_WCS in planes_tool_WCS]
#planes_tool_RCS_2 = [robot.get_tool_plane_in_RCS(tp_WCS, 2) for tp_WCS in planes_tool_WCS]

if robot.tool:
    planes_tool0_RCS_1 = [robot.get_tool0_plane_in_RCS(tp_WCS) for tp_WCS in planes_tool_WCS]
    #planes_tool0_RCS_2 = [robot.get_tool0_plane_in_RCS(tp_WCS, 2) for tp_WCS in planes_tool_WCS]

poses_tool_RCS_1 = [robot.get_tool_pose_in_RCS(tp_WCS) for tp_WCS in planes_tool_WCS]
#poses_tool_RCS_2 = [robot.get_tool_pose_in_RCS(tp_WCS, 2) for tp_WCS in planes_tool_WCS]

"""
ur_tool_geo_on_planes_WCS_nested = [robot.tool.get_transformed_geo_trfd(rg.Transform.PlaneToPlane(rg.Plane.WorldXY, tp_WCS)) for tp_WCS in ur_planes_tool_WCS]
ur_tool_geo_on_planes_WCS = [x for sublist in ur_tool_geo_on_planes_WCS_nested for x in sublist]

ur_tool_geo_on_planes_RCS_nested = [robot.tool.get_transformed_geo_trfd(rg.Transform.PlaneToPlane(rg.Plane.WorldXY, tp_RCS)) for tp_RCS in ur_planes_tool_RCS]
ur_tool_geo_on_planes_RCS = [x for sublist in ur_tool_geo_on_planes_RCS_nested for x in sublist]"""

plane_at_idx_WCS = planes_tool_WCS[idx]
T = rg.Transform.PlaneToPlane(rg.Plane.WorldXY, plane_at_idx_WCS)

if robot.tool:
    # returns the tool geo transformed by the input transformation matrix
    #tool_geo_on_plane_at_idx_WCS = robot.tool.get_transformed_geo_WCS(T)
    tool_geo_on_plane_at_idx_WCS = ghcomp.Transform(robot.tool.visual, T)
    #tool_geo_colors = robot.tool.colors
    #print tool_geo_colors
# ---------- end ur_poses ----------
pln_4 = Plane(ur_poses.plane_at_idx_WCS)
planesrf = PlaneSurface(Plane=ur_poses.planes_tool_WCS, XSize=Domain(-10, 10), YSize=Domain(-10, 10))
geo = Geometry(ur_poses.tool_geo_on_plane_at_idx_WCS)
preview_4 = CustomPreview(Geometry=geo, Shader=ur_poses.tool_geo_colors)

panel_14 = Panel(filter_3)
number_slider_5 = Slider(1, range=1..2)
use_tool_2 = BooleanToggle(False)
list_7 = ValueList({"single", "multiple": mutliple}, selected="single")
list_8 = ValueList({"joint", "linear"}, selected="linear")
gate = StreamGate(Gate=0)  # -> Target0, Target1
# Select step to send to robot
number_slider_6 = Slider(2, range=0..10)
# Robot to send to
list_9 = ValueList({"Robot 1": 1, "Robot 2": 2}, selected="Robot 1")
# Send
button_2 = Button()
python_8 = PythonScript(step=number_slider_6, rob_num=list_9, send=button_2)  # -> out, a; inputs rob_num: Int32
# ---------- python_8: Python ----------
from scriptcontext import sticky as st

ext_axes = [0,0,0]
list_ext_axes = [[0,0,0], [0,0,0]]
    
robot = st["robot_1"]
    
if robot:
    if robot.comm.running:
        print "ROBOT IS ONLINE"
        
        if send:
            
            robot.float_arbitrary = int(rob_num)
            #======================================================================================
            #====================== insert robot commands here ====================================
            #======================================================================================
            
            #if move_type == "move_linear":
            #    pass
            #elif move_type == "move_joint":
            #    pass
                
            #for example:
                
            #robot.comm.send_set_speed(speed_tcp, speed_track)
            #robot.comm.send_pose_cartesian(plane, ext_axes) #ext_axes is a list of 3 values
            robot.comm.send_pose_cartesian_joints(plane, ext_axes)
            #robot.comm.send_pose_cartesian_list(list_planes, list_ext_axes)
            #robot.comm.send_pose_cartesian_joints_list(list_planes, list_ext_axes)
            #robot.comm.send_axes_relative(joints, int_arr = None)
            #robot.comm.send_axes_absolute(joints_abb_list, int_arr = None)
            #robot.comm.wait_for_state_ready(wait_time)
            
    else:
        print "ROBOT IS OFFLINE"
# ---------- end python_8 ----------
filter_4 = StreamFilter(Gate=number_slider_6)
panel_15 = Panel(python_8.out)

# ---- group: Gripping offset
number_slider_7 = Slider(60, range=0..100)

# ---- group: inverse kinematics
py_7 = PythonScript(robot=robot)  # -> configuration
# ---------- py_7: Python ----------
from compas_fab.robots import Configuration

if robot:
    types = robot.get_configurable_joint_types()
    values = [0] * len(types)
    configuration = Configuration(values, types)
    print configuration
    print robot.get_configurable_joint_names()
# ---------- end py_7 ----------
avoid_collisions = BooleanToggle(False)
start_configuration = Data(forward_kinematics)
list_10 = ValueList({"0", "1"}, selected="1")
filter_5 = StreamFilter(Gate=list_10, Stream0=start_configuration, Stream1=py_7)

# ---- group: plan motion
# Plan motion
# If you specify the tolerance vector with [360, 1, 1], it means that
#     the frame's y-axis and z-axis are allowed to rotate about the x-axis by an
#     angle of 360 degrees, whereas the x-axis can only change 1 degree.
number_slider_8 = Slider(1, range=1..360)
py_8 = PythonScript(robot=robot)  # -> configuration
# ---------- py_8: Python ----------
from compas_fab.robots import Configuration

if robot:
    types = robot.get_configurable_joint_types()
    values = [0] * len(types)

    configuration = Configuration(values, types)
    print configuration
# ---------- end py_8 ----------
list_11 = ValueList({"don't use attached collision mesh": 0, "use attached collision mesh": 1}, selected="use attached collision mesh")
list_12 = ValueList({"0", "1"}, selected="0")
list_13 = ValueList({"RRT", "RRT*": "RRTStar", "EST", "PRM": "RPM", "PRM*": "RPMStar", "SPARS"}, selected="RRT")
filter_6 = StreamFilter(Gate=list_11, Stream1=attached.acm)
panel_16 = Panel("positions")
panel_17 = Panel("velocities")
panel_18 = Panel("accelerations")

# ----
# Configuration
# TODO Example:
# Add path constraints
main_planning_group = Text(info.main_group_name)
compute = Button()
idx = Slider(0, range=0..1)

# ---- group: inverse kinematics (continued)
inverse = GhPythonScript(
    robot=robot,
    group=main_planning_group,
    plane=move.Geometry,
    start_configuration=filter_5,
    avoid_collisions=avoid_collisions)  # -> out, group_configuration, full_configuration
# ---------- inverse: Python ----------
"""Calculate the robot's inverse kinematic for a given plane.
    Inputs:
        robot: The robot
        group: str, optional
            The planning group used for calculation. Defaults to the robot's
            main planning group.
        plane: The plane in world coordinate frame to calculate the inverse for.
        start_configuration: :class:`compas_fab.robots.Configuration`, optional
            If passed, the inverse will be calculated such that the calculated
            joint positions differ the least from the start_configuration.
            Defaults to the init configuration.
        avoid_collisions: bool, optional
            Whether or not to avoid collisions. Defaults to True.
    Output:
        group_configuration: The group configuration
        full_configuration: The full configuration
"""
from __future__ import print_function
import logging

from compas.geometry import Frame

LOGGER = logging.getLogger('roslibpy')

frame = Frame(plane.Origin, plane.XAxis, plane.YAxis)

if robot and robot.client:
    if robot.client.is_connected:
        full_configuration = robot.inverse_kinematics(frame,
                                                      start_configuration,
                                                      group=group,
                                                      avoid_collisions=avoid_collisions,
                                                      return_full_configuration=True)
        group_configuration = robot.get_group_configuration(group, full_configuration)
        print(group_configuration)
    else:
        print("Robot client is not connected")
# ---------- end inverse ----------
panel_19 = Panel(inverse.out)

# ---- group: cartesian motion
# Plan cartesian motion
group = Data(main_planning_group)
list_14 = ValueList({"don't use attached collision mesh": 0, "use attached collision mesh": 1}, selected="don't use attached collision mesh")
compute_2 = Button()
py_9 = PythonScript(robot=robot)  # -> configuration; same code as py_8
start_configuration_2 = Data(inverse.full_configuration)
list_15 = ValueList({"0", "1"}, selected="0")
py_10 = PythonScript(start_plane=start_plane, end_plane=end_plane)  # -> planes
# ---------- py_10: Python ----------
planes = [start_plane, end_plane]
print planes
# ---------- end py_10 ----------
avoid_collisions_2 = BooleanToggle(True)
filter_7 = StreamFilter(Gate=list_15, Stream0=start_configuration_2, Stream1=py_9)
filter_8 = StreamFilter(Gate=list_14, Stream1=attached.acm)
plan_cartesian_motion = PythonScript(
    robot=robot,
    group=group,
    planes=py_10,
    start_configuration=filter_7,
    max_step=Slider(0.01, range=0..0.01),
    avoid_collisions=avoid_collisions_2,
    attached_collision_meshes=filter_8,
    compute=compute_2)  # -> out, trajectory; inputs planes: list, avoid_collisions: Boolean, attached_collision_meshes: list
# ---------- plan_cartesian_motion: Python ----------
"""Calculates a cartesian motion path (linear in tool space).
    Inputs:
        robot: The robot
        group: str, optional
            The planning group used for calculation. Defaults to the robot's
            main planning group.
        planes: The planes in world coordinate frame through which the path is defined.
        start_configuration: :class:`compas_fab.robots.Configuration`, optional
            The robot's full configuration, i.e. values for all configurable
            joints of the entire robot cell, at the starting position. Defaults
            to the all-zero configuration.
        max_step: float
            The approximate distance between the calculated points. (Defined in
            the robot's units)
        avoid_collisions: bool, optional
            Whether or not to avoid collisions. Defaults to True.
        attached_collision_meshes: list of :class:`compas_fab.robots.AttachedCollisionMesh`
            Defaults to None.
        compute: bool
            Press to calculate solution.
    Output:
        :class:`compas_fab.robots.JointTrajectory`
            The calculated trajectory.
"""
from __future__ import print_function
import logging
import scriptcontext as sc

from compas.geometry import Frame

LOGGER = logging.getLogger('roslibpy')

guid = str(ghenv.Component.InstanceGuid)
response_key = "response_" + guid
if response_key not in sc.sticky:
    sc.sticky[response_key] = None

frames = [Frame(plane.Origin, plane.XAxis, plane.YAxis) for plane in planes]

if robot and robot.client and start_configuration and compute:
    if robot.client.is_connected:
        sc.sticky[response_key] = robot.plan_cartesian_motion(frames,
                                                              start_configuration=start_configuration,
                                                              group=group,
                                                              max_step=float(max_step),
                                                              avoid_collisions=bool(avoid_collisions),
                                                              attached_collision_meshes=list(attached_collision_meshes))
    else:
        print("Robot client is not connected")

trajectory = sc.sticky[response_key]
# ---------- end plan_cartesian_motion ----------
vis = PythonScript(response=plan_cartesian_motion.trajectory)  # -> P, V, A
# ---------- vis: Python ----------
from compas_ghpython import list_to_ghtree

if response:

    positions = []
    velocities = []
    accelerations = []

    for p in response.points:
        positions.append(p.positions)
        velocities.append(p.velocities)
        accelerations.append(p.accelerations)

    P = list_to_ghtree(list(zip(*positions)))
    V = list_to_ghtree(list(zip(*velocities)))
    A = list_to_ghtree(list(zip(*accelerations)))
# ---------- end vis ----------
prismatic = QuickGraph(vis.P, SortOrder=0)
py_11 = PythonScript(robot=robot, group=group, trajectory=plan_cartesian_motion.trajectory)  # -> configurations, full_configurations, fraction, time
# ---------- py_11: Python ----------
if trajectory:
    configurations = trajectory.points
    full_configurations = [robot.merge_group_with_full_configuration(c, trajectory.start_configuration, group) for c in configurations]
    start_configuration = trajectory.start_configuration
    fraction = trajectory.fraction
    time = trajectory.time_from_start
# ---------- end py_11 ----------
fraction = Panel(py_11.fraction)
time_s = Panel(py_11.time)
panel_21 = Panel(plan_cartesian_motion.out)
graph = QuickGraph(vis.V, SortOrder=0)
graph_2 = QuickGraph(vis.A, SortOrder=0)
path = GhPythonScript(robot=robot, group=group, full_configurations=py_11.full_configurations)  # -> frames, P; inputs full_configurations: list
# ---------- path: Python ----------
import Rhino.Geometry as rg

frames = []

if robot:
    for c in full_configurations:
        if c:
            frame_WCF = robot.forward_kinematics(c, group, backend='model')
            frames.append(frame_WCF)

    P = [rg.Point3d(*list(frame.point)) for frame in frames]
# ---------- end path ----------
idx_2 = Slider(0, range=0..1)
animate = PythonScript(robot=robot, group=main_planning_group, configurations=py_11.full_configurations, idx=idx_2)  # -> configuration; inputs configurations: list, idx: Int32
# ---------- animate: Python ----------
import Grasshopper
from compas_fab.utilities import map_range
from compas_fab.robots import Configuration

count = len(configurations)

for i in range(ghenv.Component.Params.Input.Count):
    nslider = ghenv.Component.Params.Input[i].Sources[0]
    if nslider.GetType() == Grasshopper.Kernel.Special.GH_NumberSlider and nslider.NickName == 'idx':
        nslider.Slider.Maximum = max(count - 1, 1)
        nslider.Slider.Minimum = 0

if count and robot and configurations[0] != None:
    configuration = configurations[idx]
# ---------- end animate ----------
pline = PolyLine(Vertices=path.P, Closed=False)
preview_5 = CustomPreview(Geometry=[path.P, pline], Material=ColourSwatch(SwatchColor=RGB(59, 137, 161)))

# ---- group: forward kinematics
forward = PythonScript(robot=robot, group=main_planning_group, full_configuration=forward_kinematics)  # -> out, frame_WCF
# ---------- forward: Python ----------
"""Calculate the robot's forward kinematic.
    Inputs:
        robot: :class:`compas_fab.robots.Robot`
            The robot.
        group: str, optional
            The planning group used for calculation. Defaults to the robot's
            main planning group.
        full_configuration : :class:`compas_fab.robots.Configuration`
            The full configuration to calculate the forward kinematic for. If no
            full configuration is passed, the zero-joint state for the other
            configurable joints is assumed.
    Output:
        :class:`Frame`
            The frame in the world coordinate frame (WCF).
"""
from __future__ import print_function
import logging

LOGGER = logging.getLogger('roslibpy')

if robot and robot.client and full_configuration:
    if robot.client.is_connected:
        frame_WCF = robot.forward_kinematics(full_configuration, group, backend='model')
        print(frame_WCF)
    else:
        print("Robot is not connected")
else:
    print("something went wrong")
    if robot:
        print("haz robot")
    else:
        print("no haz robot")
# ---------- end forward ----------
panel_24 = Panel(forward.out)

# ---- group: plan motion (continued)
group_2 = Data(main_planning_group)
python_9 = PythonScript(
    robot=robot,
    group=group_2,
    goal_plane=end_plane,
    tolerance_position=Slider(0.001, range=0..0.001),
    tolerance_xaxis_deg=number_slider_8,
    tolerance_yaxis_deg=Slider(1, range=1..360),
    tolerance_zaxis_deg=Slider(1, range=1..360))  # -> goal_constraints
# ---------- python_9: Python ----------
import math
from compas.geometry import Frame

frame = Frame(goal_plane.Origin, goal_plane.XAxis, goal_plane.YAxis)

tolerances_axes = [math.radians(tolerance_xaxis_deg), math.radians(tolerance_yaxis_deg), math.radians(tolerance_zaxis_deg)]

if robot:
    goal_constraints = robot.constraints_from_frame(frame, tolerance_position, tolerances_axes, group)
# ---------- end python_9 ----------
start_configuration_3 = Data(inverse.full_configuration)
filter_9 = StreamFilter(Gate=list_12, Stream0=start_configuration_3, Stream1=py_8)

# ----
plan_motion = PythonScript(
    robot=robot,
    group=group_2,
    start_configuration=filter_9,
    goal_constraints=python_9,
    planner_id=list_13,
    attached_collision_meshes=filter_6,
    compute=compute)  # -> out, trajectory; inputs goal_constraints: list, attached_collision_meshes: list
# ---------- plan_motion: Python ----------
"""Calculates a motion path.
    Inputs:
        robot: The robot
        group: str, optional
            The planning group used for calculation. Defaults to the robot's
            main planning group.
        start_configuration: :class:`compas_fab.robots.Configuration`, optional
            The robot's full configuration, i.e. values for all configurable
            joints of the entire robot cell, at the starting position. Defaults
            to the all-zero configuration.
        goal_constraints: list of :class:`compas_fab.robots.Constraint`
            The goal to be achieved, defined in a set of constraints.
            Constraints can be very specific, for example defining value domains
            for each joint, such that the goal configuration is included,
            or defining a volume in space, to which a specific robot link (e.g.
            the end-effector) is required to move to.
        planner_id: str
            The name of the algorithm used for path planning. Defaults to 'RRT'.
        attached_collision_meshes: list of :class:`compas_fab.robots.AttachedCollisionMesh`
            Defaults to None.
        compute: bool
            Press to calculate solution.
    Output:
        :class:`compas_fab.robots.JointTrajectory`
            The calculated trajectory.
"""
from __future__ import print_function
import logging
import scriptcontext as sc

guid = str(ghenv.Component.InstanceGuid)
response_key = "response_" + guid
if response_key not in sc.sticky:
    sc.sticky[response_key] = None

LOGGER = logging.getLogger('roslibpy')

if robot and robot.client and start_configuration and compute:
    if robot.client.is_connected:
        sc.sticky[response_key] = robot.plan_motion(goal_constraints,
                                                    start_configuration,
                                                    group,
                                                    planner_id=str(planner_id),
                                                    attached_collision_meshes=list(attached_collision_meshes))
    else:
        print("Robot client is not connected.")

trajectory = sc.sticky[response_key]
# ---------- end plan_motion ----------
py_12 = PythonScript(robot=robot, group=group_2, trajectory=plan_motion.trajectory)  # -> configurations, full_configurations, fraction, time; same code as py_11
panel_25 = Panel(plan_motion.out)
animate_2 = PythonScript(robot=robot, group=group_2, configurations=py_12.full_configurations, idx=idx)  # -> configuration; inputs configurations: list, idx: Int32; same code as animate

# ---- group: plan motion (continued)
vis_2 = PythonScript(response=plan_motion.trajectory)  # -> P, V, A, time
# ---------- vis_2: Python ----------
from compas_ghpython import list_to_ghtree

if response:

    positions = []
    velocities = []
    accelerations = []
    time_from_start = []

    for p in response.points:
        positions.append(p.positions)
        velocities.append(p.velocities)
        accelerations.append(p.accelerations)
        time_from_start.append(p.time_from_start.seconds)

    P = list_to_ghtree(list(zip(*positions)))
    V = list_to_ghtree(list(zip(*velocities)))
    A = list_to_ghtree(list(zip(*accelerations)))

    time = time_from_start[-1]
    print time
# ---------- end vis_2 ----------
time_s_2 = Panel(vis_2.time)
prismatic_2 = QuickGraph(vis_2.P, SortOrder=0)
fraction_2 = Panel(py_12.fraction)
time_s_3 = Panel(py_12.time)
graph_3 = QuickGraph(vis_2.V, SortOrder=0)
graph_4 = QuickGraph(vis_2.A, SortOrder=0)
path_2 = GhPythonScript(robot=robot, group=group_2, full_configurations=py_12.full_configurations)  # -> frames, P; inputs full_configurations: list; same code as path
pline_2 = PolyLine(Vertices=path_2.P, Closed=False)
preview_6 = CustomPreview(Geometry=[path_2.P, pline_2], Material=ColourSwatch(SwatchColor=RGB(59, 161, 95)))

# ----
# Visualisation
# Select configuration input: from fk, ik, path, or from real robot
list_16 = ValueList({"0 forward_kinematics": 0, "1 inverse_kinematics": 1, "2 cartesian motion": 2, "3 free-space motion": 3}, selected="1 inverse_kinematics")
filter_10 = StreamFilter(Gate=list_16, Stream0=forward_kinematics, Stream1=inverse.full_configuration, Stream2=animate, Stream3=animate_2)
show_end_effector_frame = BooleanToggle(True)
show_base_frame = BooleanToggle(False)
show_collision = BooleanToggle(False)
show_frames = BooleanToggle(False)
show_visual = BooleanToggle(True)
visualize = PythonScript(
    robot=robot,
    full_configuration=filter_10,
    show_visual=show_visual,
    show_collision=show_collision,
    show_frames=show_frames,
    show_base_frame=show_base_frame,
    show_end_effector_frame=show_end_effector_frame)  # -> out, visual, collision, frames, base_frame_WCF, ee_frame_WCF
# ---------- visualize: Python ----------
"""Calculates a cartesian motion path (linear in tool space).
    Inputs:
        robot: The robot
        group: str
            The planning group used for visualisation
        full_configuration: :class:`compas_fab.robots.Configuration`
            The robot's full configuration to display.
        show_visual: bool
           Whether or not to show the robot's visual meshes.
        show_collision: bool
           Whether or not to show the robot's collision meshes.
        show_frames: bool
           Whether or not to show the robot's joint frames.
        show_base_frame: bool
           Whether or not to show the robot's base frame.
        show_end_effector_frame: bool
            Whether or not to show the robot's end-effector frame.
    Output:
        visual: The robot's visual meshes.
        collision: The robot's collision meshes.
        frames: The robot's joint frames.
        base_frame_WCF: The robot's base frame.
        ee_frame_WCF: The robot's end-effector frame.
"""
from __future__ import print_function

if robot and full_configuration:
    robot.update(full_configuration, visual=show_visual, collision=show_collision)
    print(full_configuration)

    if show_visual:
        visual = robot.draw_visual()

    if show_collision:
        collision = robot.draw_collision()

    if show_frames:
        axes = robot.transformed_axes(full_configuration)
        frames = robot.transformed_frames(full_configuration)

    if show_base_frame:
        base_frame_WCF = robot.get_base_frame(group, full_configuration)

    if show_end_effector_frame:
        ee_frame_WCF = robot.get_end_effector_frame(group, full_configuration)
        print("End-effector", ee_frame_WCF)
# ---------- end visualize ----------
geo_2 = Geometry(visualize.visual)
geo_3 = Geometry(visualize.collision)
py_13 = PythonScript(robot=robot)  # -> scale
# ---------- py_13: Python ----------
if robot:
    scale = robot.scale_factor * 0.1
else:
    scale = 1.
# ---------- end py_13 ----------
draw = GhPythonScript(frames=[visualize.frames, visualize.ee_frame_WCF, visualize.base_frame_WCF], scale=py_13)  # -> P, V, C, W; inputs frames: list
# ---------- draw: Python ----------
from System.Drawing import Color
from compas_ghpython import draw_frame

red = Color.FromArgb(255, 0, 0)
green = Color.FromArgb(0, 255, 0)
blue = Color.FromArgb(0, 0, 255)

P = []
V = []
C = []

scale = float(scale)

for frame in frames:
    if not frame:
        continue
    plane = draw_frame(frame)
    P += [plane.Origin] * 3
    V.append(plane.XAxis * scale)
    V.append(plane.YAxis * scale)
    V.append(plane.ZAxis * scale)
    C += [red, green, blue]

W = 3
# ---------- end draw ----------
preview_7 = CustomPreview(Geometry=geo_2, Shader=ColourSwatch(SwatchColor=RGB(105, 105, 105)))
vdisex = VectorDisplayEx(Point=draw.P, Vector=draw.V, Colour=draw.C, Width=draw.W)
# Robotic process:
# 
# START POSITION
# 1. Pre-glue strips at 90-degrees (node 0)
# 2. Mark grasp offset on strips
# 3. position robot A in grasp position
# 4. position robot B in grasp position
# 5. open both grippers
# 6. manually positon strips in grippers
# 7. close both grippers
# 
# FORM NODE 1
# 8. open robot A gripper
# 9. move along path of bigon shape + offset distance
# 10. close gripper at gripping location
# 11. open robot b gripper
# 12. path-plan to grasp strand a below robot a
# 13. robot b close gripper
# 14. robot a open gripper
# 15. robot a move to approximate location of floating srand b. open gripper
# 16. manually place floating strand b in gripper, close gripper a
# 17. robot a move to form node 1
# 18. glue it!
panel_26 = Panel(visualize.out)

# ----
# Evaluate at exact node length
# Evaluate at node length,
# plus offset distance
# Evaluate at exact node length
# Scale to 200 mm
# Split into two strips
# Evaluate at node length,
# plus offset distance
# Interp planes to approximate bending path.
# 1. trim start and end curves
# 2. interp curves
# 3. interp planes along curve ends
# 4. extend each curve to correct curve length
# Strip B
# Strip A
panel_27 = Panel("C:\Users\lkram\Documents\GitHub\robotic_lacing\gh\data\Bigon80degree.dat")
file = ReadFile(File=panel_27, PerLineParse=True)
split = TextSplit(Text=file, Separators=",")
multiplication = Multiplication(A=split, B="200")
split_2 = SplitTree(Data=simplify(multiplication), Masks=flatten("{(0 to 40)}"))  # -> Positive, Negative
number_slider_9 = Slider(150, range=0..1000)
cluster_3 = Cluster_3(L=split_2.Positive)  # -> C, flatten(P), flatten(V_2), flatten(V), flatten(V_3)
cluster_4 = Cluster_3(L=split_2.Negative)  # -> C, flatten(P), flatten(V_2), flatten(V), flatten(V_3)
rev = Reverse(Vector=reverse(cluster_4.V_2))
rev_2 = Reverse(Vector=reverse(cluster_4.V_3))
flip = FlipCurve(Curve=cluster_4.C)  # -> Curve, Flag
rev_3 = ReverseList(List=cluster_4.P)
cluster_5 = Cluster_7(_0_0=rev_3, _0_1=rev, _0_2=rev_2, i="0", A="0")
cluster_6 = Cluster_7(_0_0=rev_3, _0_1=rev, _0_2=rev_2, i="0", A=number_slider_7)
cluster_7 = Cluster_6(_0_0=cluster_3.P, _0_1=cluster_3.V_2, _0_2=cluster_3.V_3, i="0", A="0")
cluster_8 = Cluster_6(_0_0=cluster_3.P, _0_1=cluster_3.V_2, _0_2=cluster_3.V_3, i="0", A=number_slider_7)
cluster_9 = Cluster_6(_0_0=cluster_3.P, _0_1=cluster_3.V_2, _0_2=cluster_3.V_3, i="-1", A="0")
cluster_10 = Cluster_8(_0_0=cluster_3.P, _0_1=cluster_3.V_2, _0_2=cluster_3.V_3, i="-1", A=number_slider_7)
cluster_11 = Cluster_7(_0_0=rev_3, _0_1=rev, _0_2=rev_2, i="-1", A="0")
cluster_12 = Cluster_9(_0_0=rev_3, _0_1=rev, _0_2=rev_2, i="-1", A=number_slider_7)

# ---- group: Step 0
cluster_13 = Cluster_5(crv=flip.Curve, L=rev_2, L_2=rev, L_3=number_slider_9)  # -> S, C
cluster_14 = Cluster_5(crv=cluster_3.C, L=cluster_3.V_3, L_2=cluster_3.V_2, L_3=number_slider_9)  # -> S, C

# ---- group: Step 1
cluster_15 = Cluster_4(S=rev_3, D=rev)  # -> S_2, C
cluster_16 = Cluster_4(S=cluster_3.P, D=cluster_3.V_2)  # -> S_2, C

# ---- group: Node 1
pln_5 = Plane(cluster_5)

# ---- group: Node 1 offset
pln_6 = Plane(cluster_6)

# ---- group: Node 1
pln_7 = Plane(cluster_7)

# ---- group: Node 1 offset
pln_8 = Plane(cluster_8)

# ---- group: Node 2 offset - start
addition = Addition(A="200", B=number_slider_9, C=number_slider_7)
crv_2 = Curve(cluster_13.C)
eval = EvaluateLength(Curve=crv_2, Length=addition, Normalized=False)  # -> Point, Tangent, Parameter
srf_cp = SurfaceClosestPoint(Point=eval.Point, Surface=cluster_13.S)  # -> Point, UVPoint, Distance
evalsrf = EvaluateSurface(Surface=cluster_13.S, Point=srf_cp.UVPoint)  # -> Point, Normal, UDirection, VDirection, Frame
rev_4 = Reverse(Vector=evalsrf.VDirection)
rev_5 = Reverse(Vector=evalsrf.UDirection)
pl_3 = ConstructPlane(Origin=evalsrf.Point, XAxis=rev_4, YAxis=rev_5)

addition_2 = Addition(A="200", B=number_slider_9)
crv_3 = Curve(cluster_13.C)
eval_2 = EvaluateLength(Curve=crv_3, Length=addition_2, Normalized=False)  # -> Point, Tangent, Parameter
srf_cp_2 = SurfaceClosestPoint(Point=eval_2.Point, Surface=cluster_13.S)  # -> Point, UVPoint, Distance
evalsrf_2 = EvaluateSurface(Surface=cluster_13.S, Point=srf_cp_2.UVPoint)  # -> Point, Normal, UDirection, VDirection, Frame
rev_6 = Reverse(Vector=evalsrf_2.VDirection)
rev_7 = Reverse(Vector=evalsrf_2.UDirection)
pl_4 = ConstructPlane(Origin=evalsrf_2.Point, XAxis=rev_6, YAxis=rev_7)

addition_3 = Addition(A="200", B=number_slider_9, C=number_slider_7)
crv_4 = Curve(cluster_14.C)
eval_3 = EvaluateLength(Curve=crv_4, Length=addition_3, Normalized=False)  # -> Point, Tangent, Parameter
srf_cp_3 = SurfaceClosestPoint(Point=eval_3.Point, Surface=cluster_14.S)  # -> Point, UVPoint, Distance
evalsrf_3 = EvaluateSurface(Surface=cluster_14.S, Point=srf_cp_3.UVPoint)  # -> Point, Normal, UDirection, VDirection, Frame
pl_5 = ConstructPlane(Origin=evalsrf_3.Point, XAxis=evalsrf_3.VDirection, YAxis=evalsrf_3.UDirection)

# ---- group: Node 2 - start
addition_4 = Addition(A="200", B=number_slider_9)
crv_5 = Curve(cluster_14.C)
eval_4 = EvaluateLength(Curve=crv_5, Length=addition_4, Normalized=False)  # -> Point, Tangent, Parameter
srf_cp_4 = SurfaceClosestPoint(Point=eval_4.Point, Surface=cluster_14.S)  # -> Point, UVPoint, Distance
evalsrf_4 = EvaluateSurface(Surface=cluster_14.S, Point=srf_cp_4.UVPoint)  # -> Point, Normal, UDirection, VDirection, Frame
pl_6 = ConstructPlane(Origin=evalsrf_4.Point, XAxis=evalsrf_4.VDirection, YAxis=evalsrf_4.UDirection)

# ---- group: Node 2
pln_9 = Plane(cluster_9)

# ---- group: Node 2 offset - end
pln_10 = Plane(cluster_10)

# ---- group: Node 2
pln_11 = Plane(cluster_11)

# ---- group: Node 2 offset - end
pln_12 = Plane(cluster_12)

# ---- group: Strip A - before bending
merge = Merge(Data1=flatten(pln_6), Data2=flatten(pl_3))
crv_6 = Curve(cluster_13.C)
ptstrimcrv = PointsTrimCurve(Curve=crv_6, Points=merge, Flip=True)  # -> Trimmed, SubDomains, Intersected
crv_7 = Curve(ptstrimcrv.Trimmed)

# ---- group: Strip A - after bending
merge_2 = Merge(Data1=flatten(pln_6), Data2=flatten(pln_12))
crv_8 = Curve(cluster_15.C)
ptstrimcrv_2 = PointsTrimCurve(Curve=crv_8, Points=merge_2, Flip=True)  # -> Trimmed, SubDomains, Intersected
crv_9 = Curve(ptstrimcrv_2.Trimmed)

# ---- group: Strip B - before bending
merge_3 = Merge(Data1=flatten(pln_8), Data2=flatten(pl_6))
crv_10 = Curve(cluster_14.C)
ptstrimcrv_3 = PointsTrimCurve(Curve=crv_10, Points=merge_3, Flip=True)  # -> Trimmed, SubDomains, Intersected
crv_11 = Curve(ptstrimcrv_3.Trimmed)

# ---- group: Strip B - after bending
merge_4 = Merge(Data1=flatten(pln_8), Data2=flatten(pln_10))
crv_12 = Curve(cluster_16.C)
ptstrimcrv_4 = PointsTrimCurve(Curve=crv_12, Points=merge_4, Flip=True)  # -> Trimmed, SubDomains, Intersected
crv_13 = Curve(ptstrimcrv_4.Trimmed)

# ----
cluster_17 = Cluster_10(A=crv_7, B=crv_9, A_2=pl_3, B_2=pln_12)
cluster_18 = Cluster_10(A=crv_11, B=crv_13, A_2=pl_6, B_2=pln_9)
geo_4 = Geometry(cluster_17)
geo_5 = Geometry(cluster_18)

# ==== cluster Cluster
init = ClusterInput()

rob_11_z1 = Brep(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)
rob_11_z_base = Brep([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])
rob_11_12_y = Brep([null, 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])
rob_11_12_21_22_x = Brep([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])
rob_11_z2 = Brep([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])
mesh = Mesh(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)
mesh_2 = Mesh([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])
mesh_3 = Mesh([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])
mesh_4 = Mesh([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])
mesh_5 = Mesh([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])

mjoin = MeshJoin(Meshes=mesh_3)
mjoin_2 = MeshJoin(Meshes=mesh_2)
mjoin_3 = MeshJoin(Meshes=mesh_4)
mjoin_4 = MeshJoin(Meshes=mesh)
mjoin_5 = MeshJoin(Meshes=mesh_5)
merge = Merge(Data1=mjoin_4, Data2=mjoin_2, Data3=mjoin, Data4=mjoin_3, Data5=mjoin_5)
xy = XYPlane(Origin=Point(0, 0, 0))
set_tool = PythonScript(init=init, gantry_geo=merge, gantry_plane=xy)  # -> out, gantry, gantry_geo; inputs gantry_geo: list of Mesh, gantry_plane: Plane
# ---------- set_tool: Python ----------
import Rhino.Geometry as rg
import ghpythonlib.components as ghcomp
import math as m

#from abb_communication.clients.rfl_robot import Tool
from abb_communication.clients.rfl_robot.gantry import Gantry
from abb_communication.geometry import Frame

gantry = Gantry(gantry_geo, gantry_plane)

gantry_geo_n = gantry.geo
# ---------- end set_tool ----------
geo = Geometry(set_tool.gantry_geo)
gantry = ClusterOutput(set_tool.gantry)

# ==== cluster Tool

# ---- group: Lacing tool
pln = Plane(PlaneXZ(0, -3.293934009, 162.974997))
mesh = Mesh(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)
entwine = Entwine(Branch00=mesh, Branch01=pln, Branch02="lacing_tool", FlattenInputs=True)

# ----
# Init
init = ClusterInput()
# Tool number
int = ClusterInput()
int_2 = Integer(int)
python = GhPythonScript(tool_nb=int_2)
# ---------- python: Python ----------
from scriptcontext import sticky as st

st["tool_nb"] = tool_nb
# ---------- end python ----------
select_tool = StreamFilter(Gate=int_2, Stream1=entwine)
bang = ExplodeTree(Data=select_tool)  # -> Branch0, Branch1, Branch2
python_2 = GhPythonScript(init=init, tool_geo=bang.Branch0, tool_plane=bang.Branch1, tool_name=bang.Branch2)  # -> out, tool, tool_name; inputs tool_geo: list of Mesh
# ---------- python_2: Python ----------
import Rhino.Geometry as rg
from compas_fab.robots import Tool

tool_frame = rg.Plane(tool_plane)
tool = Tool(tool_geo, tool_frame, collision=None, name=tool_name)
# ---------- end python_2 ----------
# Cluster outputs the tool object.
tool = ClusterOutput(python_2.tool)

# ==== cluster Cluster_2

# ---- group: IRB 4600
base = Mesh([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])
l1 = Mesh(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)
l2 = Mesh(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)
l3 = Mesh(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)
l4 = Mesh(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)
l5 = Mesh(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)
l6 = Mesh(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)
mesh = Mesh([l1, l2, l3, l4, l5, l6])

# ---- group: IRB 120
# Base
# Robot
# Joint planes
pln = Plane(PlaneXY(0, 0, 0))
pln_2 = Plane(Plane(origin=(-0.001339692596, -0.0007972566157, 290.0064808), x=(-4.619526408e-06, -2.749099309e-06, 1), y=(1, -1.269953685e-11, 4.619526408e-06)))
pln_3 = Plane(Plane(origin=(-0.001339692596, -0.0007972566157, 560.0087587), x=(0, 0, 1), y=(1, 0, 0)))
pln_4 = Plane(Plane(origin=(149.6000061, 4.391681555e-05, 630.0000131), x=(0, 0, -1), y=(0, 1, 0)))
pln_5 = Plane(Plane(origin=(302.0000023, 4.391681555e-05, 630.0000131), x=(0, 0, 1), y=(1, 0, 0)))
pln_6 = Plane(Plane(origin=(361.0003349, 0.02997483271, 630.0305599), x=(0, 0, -1), y=(0, 1, 0)))
brep = Brep(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)
brep_2 = Brep(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)
brep_3 = Brep(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)
brep_4 = Brep(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)
brep_5 = Brep(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)
brep_6 = Brep(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)
brep_7 = Brep(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)
brep_8 = Brep([brep, brep_2, brep_3, brep_4, brep_5, brep_6])
pln_7 = Plane([pln, pln_2, pln_3, pln_4, pln_5, pln_6])

# ----
init = ClusterInput()
G = ClusterInput()
data = ClusterInput()
# Robot IP
data_2 = Data(data)
entwine = Entwine(Branch01=mesh, FlattenInputs=True)
entwine_2 = Entwine(Branch00=brep_8, Branch01=brep_7, Branch02=pln_7, FlattenInputs=True)
filter = StreamFilter(Gate=G, Stream0=entwine_2, Stream1=entwine)
bang = ExplodeTree(Data=filter)  # -> Branch0, Branch1, Branch2
if = PythonScript(init=init, ip=data_2, link_geo=bang.Branch0, base_geo=bang.Branch1, joint_planes=bang.Branch2)  # -> robot; inputs link_geo: list of Mesh, base_geo: list of Mesh, joint_planes: list of Plane
# ---------- if: Python ----------
from abb_communication.clients import Robot

ip_abb = ip
robot = Robot(link_geo, base_geo, joint_planes, ip_abb = ip_abb)
# ---------- end if ----------
robot = ClusterOutput(if)

# ==== cluster Cluster_3
L = ClusterInput()
item = ListItem(List=L, Index=0, Wrap=True)  # -> Item, Item1, Item2, Item3, Item4, Item5, Item6, Item7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
number_slider = Slider(5, range=0..10)
pt = ConstructPoint(XCoordinate=item.Item5, YCoordinate=item.Item6, ZCoordinate=item.Item7)
vec = VectorXYZ(XComponent=item.Item8, YComponent=item.Item9, ZComponent=item.Item10)  # -> Vector, Length
vec_2 = VectorXYZ(XComponent=item.Item14, YComponent=item.Item15, ZComponent=item.Item16)  # -> Vector, Length
vec_3 = VectorXYZ(XComponent=item.Item11, YComponent=item.Item12, ZComponent=item.Item13)  # -> Vector, Length
division = Division(A=item.Item1, B="200")
intcrv = Interpolate(Vertices=flatten(pt), Degree=3, Periodic=False, KnotStyle=1)  # -> Curve, Length, Domain
amp = Amplitude(Vector=vec_3.Vector, Amplitude=number_slider)
amp_2 = Amplitude(Vector=vec.Vector, Amplitude=number_slider)
amp_3 = Amplitude(Vector=vec_2.Vector, Amplitude=number_slider)
eval = EvaluateCurve(Curve=reparameterize(intcrv.Curve), Parameter=division)  # -> Point, Tangent, Angle
V = ClusterOutput(amp)
V_2 = ClusterOutput(amp_2)
V_3 = ClusterOutput(amp_3)
P = ClusterOutput(eval.Point)
C = ClusterOutput(intcrv.Curve)

# ==== cluster Cluster_4
number_slider = Slider(5, range=0..10)
S = ClusterInput()
D = ClusterInput()
neg = Negative(Value=number_slider)
line = LineSDL(Start=S, Direction=D, Length=graft([number_slider, neg]))  # -> flatten(Line)
intcrv = Interpolate(Vertices=S, Degree=3, Periodic=False, KnotStyle=1)  # -> Curve, Length, Domain
join = JoinCurves(Curves=line, Preserve=False)
item = ListItem(List=D, Index=0, Wrap=True)  # -> Item1, Item
ext = ExtendCurve(Curve=intcrv.Curve, Type=0, Start=Slider(150, range=0..1000), End=Slider(300, range=0..1000))
item_2 = ListItem(List=join, Index=0, Wrap=True)
end = EndPoints(Curve=ext)  # -> Start, End
line_2 = LineSDL(Start=end.End, Direction=item.Item1, Length=[number_slider, neg])  # -> flatten(Line)
line_3 = LineSDL(Start=end.Start, Direction=item.Item, Length=[number_slider, neg])  # -> flatten(Line)
join_2 = JoinCurves(Curves=line_2, Preserve=False)
join_3 = JoinCurves(Curves=line_3, Preserve=False)
ins = InsertItems(List=join, Item=join_2, Indices="-1", Wrap=True)
ins_2 = InsertItems(List=ins, Item=join_3, Indices="0", Wrap=True)
swp1 = Sweep1(Rail=ext, Sections=ins_2, Miter=1)
S_2 = ClusterOutput(swp1)
C = ClusterOutput(ext)

# ==== cluster Cluster_5
crv = ClusterInput()
L = ClusterInput()
L_2 = ClusterInput()
crv_2 = Curve(crv)
L_3 = ClusterInput()
number_slider = Slider(5, range=0..10)
end = EndPoints(Curve=crv_2)  # -> Start, End
item = ListItem(List=L_2, Index=0, Wrap=True)
item_2 = ListItem(List=L, Index=0, Wrap=True)
rev = Reverse(Vector=item_2)
neg = Negative(Value=number_slider)
line = LineSDL(Start=end.Start, Direction=rev, Length=L_3)
ext = ExtendCurve(Curve=line, Type=0, Start=Slider(400, range=0..1000), End=0)
end_2 = EndPoints(Curve=ext)  # -> Start, End
line_2 = LineSDL(Start=end_2.Start, Direction=item, Length=[neg, number_slider])
join = JoinCurves(Curves=line_2, Preserve=False)
swp1 = Sweep1(Rail=ext, Sections=join, Miter=1)
crv_3 = Curve(ext)
flip = FlipCurve(Curve=crv_3)  # -> Curve, Flag
S = ClusterOutput(swp1)
C = ClusterOutput(flip.Curve)

# ==== cluster Cluster_6
_0_2 = ClusterInput()
_0_0 = ClusterInput()
_0_1 = ClusterInput()
A = ClusterInput()
i = ClusterInput()
entwine = Entwine(Branch00=_0_0, Branch01=_0_1, Branch02=_0_2, FlattenInputs=True)
geo = Geometry(_0_0)
item = ListItem(List=entwine, Index=i, Wrap=True)
bang = ExplodeTree(Data=item)  # -> Branch0, Branch1, Branch2
vdis = VectorDisplay(Anchor=bang.Branch0, Vector=bang.Branch2)
vdis_2 = VectorDisplay(Anchor=bang.Branch0, Vector=bang.Branch1)
pl = ConstructPlane(Origin=bang.Branch0, XAxis=bang.Branch1, YAxis=bang.Branch2)
amp = Amplitude(Vector=bang.Branch2, Amplitude=A)
move = Move(Geometry=pl, Motion=expr("-x", amp))  # -> Geometry, Transform
geo_2 = Geometry(pl)
flippln = FlipPlane(Plane=move.Geometry, FlipX=False, FlipY=True, FlipZ=False)  # -> Flipped, R
F = ClusterOutput(flippln.Flipped)

# ==== cluster Cluster_7
_0_2 = ClusterInput()
_0_0 = ClusterInput()
_0_1 = ClusterInput()
A = ClusterInput()
i = ClusterInput()
entwine = Entwine(Branch00=_0_0, Branch01=_0_1, Branch02=_0_2, FlattenInputs=True)
geo = Geometry(_0_0)
item = ListItem(List=entwine, Index=i, Wrap=True)
bang = ExplodeTree(Data=item)  # -> Branch0, Branch1, Branch2
vdis = VectorDisplay(Anchor=bang.Branch0, Vector=bang.Branch2)
vdis_2 = VectorDisplay(Anchor=bang.Branch0, Vector=bang.Branch1)
pl = ConstructPlane(Origin=bang.Branch0, XAxis=bang.Branch1, YAxis=bang.Branch2)
amp = Amplitude(Vector=bang.Branch2, Amplitude=A)
move = Move(Geometry=pl, Motion=expr("-x", amp))  # -> Geometry, Transform
geo_2 = Geometry(pl)
flippln = FlipPlane(Plane=move.Geometry, FlipX=True, FlipY=False, FlipZ=False)  # -> Flipped, R
F = ClusterOutput(flippln.Flipped)
geo_3 = Geometry(flippln.Flipped)

# ==== cluster Cluster_8
_0_2 = ClusterInput()
_0_0 = ClusterInput()
_0_1 = ClusterInput()
A = ClusterInput()
i = ClusterInput()
entwine = Entwine(Branch00=_0_0, Branch01=_0_1, Branch02=_0_2, FlattenInputs=True)
geo = Geometry(_0_0)
item = ListItem(List=entwine, Index=i, Wrap=True)
bang = ExplodeTree(Data=item)  # -> Branch0, Branch1, Branch2
vdis = VectorDisplay(Anchor=bang.Branch0, Vector=bang.Branch2)
vdis_2 = VectorDisplay(Anchor=bang.Branch0, Vector=bang.Branch1)
pl = ConstructPlane(Origin=bang.Branch0, XAxis=bang.Branch1, YAxis=bang.Branch2)
amp = Amplitude(Vector=bang.Branch2, Amplitude=A)
geo_2 = Geometry(pl)
move = Move(Geometry=pl, Motion=amp)  # -> Geometry, Transform
flippln = FlipPlane(Plane=move.Geometry, FlipX=False, FlipY=True, FlipZ=False)  # -> Flipped, R
F = ClusterOutput(flippln.Flipped)

# ==== cluster Cluster_9
_0_2 = ClusterInput()
_0_0 = ClusterInput()
_0_1 = ClusterInput()
A = ClusterInput()
i = ClusterInput()
entwine = Entwine(Branch00=_0_0, Branch01=_0_1, Branch02=_0_2, FlattenInputs=True)
geo = Geometry(_0_0)
item = ListItem(List=entwine, Index=i, Wrap=True)
bang = ExplodeTree(Data=item)  # -> Branch0, Branch1, Branch2
vdis = VectorDisplay(Anchor=bang.Branch0, Vector=bang.Branch2)
vdis_2 = VectorDisplay(Anchor=bang.Branch0, Vector=bang.Branch1)
pl = ConstructPlane(Origin=bang.Branch0, XAxis=bang.Branch1, YAxis=bang.Branch2)
amp = Amplitude(Vector=bang.Branch2, Amplitude=A)
geo_2 = Geometry(pl)
move = Move(Geometry=pl, Motion=amp)  # -> Geometry, Transform
flippln = FlipPlane(Plane=move.Geometry, FlipX=True, FlipY=False, FlipZ=False)  # -> Flipped, R
F = ClusterOutput(flippln.Flipped)
geo_3 = Geometry(flippln.Flipped)

# ==== cluster Cluster_10
A = ClusterInput()
B = ClusterInput()
range = Range(Domain=Domain(0, 1), Steps=Slider(10, range=0..10))
twn2crvs = TweenTwoCurves(CurveA=A, CurveB=B, Factor=range, Refit=0, PointSample=0)
item = ListItem(List=twn2crvs, Index=0, Wrap=True)
len = Length(Curve=item)
len_2 = Length(Curve=twn2crvs)
subtraction = Subtraction(A=len, B=len_2)
ext = ExtendCurve(Curve=twn2crvs, Type=0, Start="0", End=subtraction)
len_3 = Length(Curve=ext)
end = EndPoints(Curve=ext)  # -> Start, End
intcrv = Interpolate(Vertices=end.End, Degree=3, Periodic=False, KnotStyle=1)  # -> Curve, Length, Domain
A_2 = ClusterInput()
B_2 = ClusterInput()
panel = Panel(len_3)
twn2plnscrv = TweenTwoPlanesOnCurve(PlaneA=A_2, PlaneB=B_2, Curve=intcrv.Curve, Factor=range, Weighted=False, Quaternion=True)
T = ClusterOutput(twn2plnscrv)
