# Grasshopper definition robotic_lacing_robotsplugin.gh (Grasshopper 1.0.7)
# plug-ins: Robots, Pufferfish

panel = Panel("C:\Users\lkram\Documents\GitHub\robotic_lacing\gh\data\Bigon80degree.dat")

# ---- group: Lacing tool
# orientation relative to flange
# (use world origin as flange)
# no spaces
# tool center point (tcp)
# tool geometry
# (must be a single mesh)
brep = Brep(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)
brep_2 = Brep([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])
sunion = SolidUnion(Breps=brep_2)
tool_name = Panel("lacing_tool")
mesh = Mesh(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)
mesh_2 = Mesh(sunion)
mesh_3 = Mesh(brep)
weight = Panel("2.0")
pt = Point(Point(0, -1.293933875, 162.974997))
mjoin = MeshJoin(Meshes=[mesh, mesh_2, mesh_3])
pl = ConstructPlane(Origin=pt, XAxis=Vector(1, 0, 0), YAxis="0,0,1")
rotate = Rotate(Geometry=mjoin, Angle=-1.570796327, Plane=PlaneXY(0, 0, 0))  # -> Geometry, Transform
rotate_2 = Rotate(Geometry=pl, Angle=-1.570796327, Plane=PlaneXY(0, 0, 0))  # -> Geometry, Transform
yz = YZPlane(Origin=rotate_2.Geometry)
rotate_3 = Rotate(Geometry=rotate_2.Geometry, Angle=1.570796327, Plane=yz)  # -> Geometry, Transform
tool = CreateTool(Name=tool_name, TCP=rotate_3.Geometry, Weight=weight, Mesh=rotate.Geometry)  # -> Tool, TCP

# ---- group: Lacing tool update 10/7
# orientation relative to flange
# (use world origin as flange)
# no spaces
# tool center point (tcp)
# tool geometry
# (must be a single mesh)
brep_3 = Brep([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])
brep_4 = Brep([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])
sunion_2 = SolidUnion(Breps=brep_4)
tool_name_2 = Panel("lacing_tool_1007")
mesh_4 = Mesh(sunion_2)
mesh_5 = Mesh(brep_3)
pt_2 = Point(Point(0, 0, 97.97499847))
mjoin_2 = MeshJoin(Meshes=[mesh_4, mesh_5])
pl_2 = ConstructPlane(Origin=pt_2, XAxis=Vector(1, 0, 0), YAxis="0,0,1")
rotate_4 = Rotate(Geometry=mjoin_2, Angle=-1.570796327, Plane=PlaneXY(0, 0, 0))  # -> Geometry, Transform
rotate_5 = Rotate(Geometry=pl_2, Angle=-1.570796327, Plane=PlaneXY(0, 0, 0))  # -> Geometry, Transform
yz_2 = YZPlane(Origin=rotate_5.Geometry)
weight_2 = Panel("2.0")
rotate_6 = Rotate(Geometry=rotate_5.Geometry, Angle=1.570796327, Plane=yz_2)  # -> Geometry, Transform
tool_2 = CreateTool(Name=tool_name_2, TCP=rotate_6.Geometry, Weight=weight_2, Mesh=mjoin_2)  # -> Tool, TCP

# ----
xy = XYPlane(Origin=Point(0, 0, 0))
vec = VectorXYZ(
    XComponent=Slider(387, range=-700..700),
    YComponent=Slider(-151, range=-700..700),
    ZComponent=Slider(-267, range=-700..700))  # -> Vector, Length
move = Move(Geometry=xy, Motion=vec.Vector)  # -> Geometry, Transform

# ---- group: Robots
# Robot B
# Robot A
list = ValueList({"iaac-KR150-2_110", "iaac-IRB140", "iaac-IRB120", "AA-KR60", "AA-KR30", "AA-KR60_KR30", "EXArchitects-IRB6700", "Taiwan-IRB1600", "Taiwan-KR6", "Taiwan-KR10"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}, selected="Bartlett-IRB120")
yz_3 = YZPlane(Origin=Point(0, 0, 0))
pt_3 = Point(move.Geometry)
mirror = Mirror(Geometry=pt_3, Plane=yz_3)  # -> Geometry, Transform
load_robot = LoadRobotSystem(Name=list, Base=mirror.Geometry)
load_robot_2 = LoadRobotSystem(Name=list, Base=pt_3)

# ----
file = ReadFile(File=panel, PerLineParse=True)
split = TextSplit(Text=file, Separators=",")
# Scale to 200 mm
multiplication = Multiplication(A=split, B="200")

# ---- group: Gripping offset
number_slider = Slider(60, range=0..100)

# ----
# Split into two strips
split_2 = SplitTree(Data=simplify(multiplication), Masks=flatten("{(0 to 40)}"))  # -> Positive, Negative
cluster = Cluster(L=split_2.Negative)  # -> C, flatten(P), flatten(V_2), flatten(V), flatten(V_3)
cluster_2 = Cluster(L=split_2.Positive)  # -> C, flatten(P), flatten(V_2), flatten(V), flatten(V_3)
line = LineSDL(Start=cluster_2.P, Direction=cluster_2.V_2, Length=1)
line_2 = LineSDL(Start=cluster_2.P, Direction=cluster_2.V, Length=1)
line_3 = LineSDL(Start=cluster.P, Direction=cluster.V_3, Length=1)
line_4 = LineSDL(Start=cluster.P, Direction=cluster.V_2, Length=1)
line_5 = LineSDL(Start=cluster.P, Direction=cluster.V, Length=1)
line_6 = LineSDL(Start=cluster_2.P, Direction=cluster_2.V_3, Length=1)
entwine = Entwine(Branch00=cluster.C, Branch01=cluster.P, Branch02=line_4, Branch03=line_5, Branch04=line_3, FlattenInputs=True)
entwine_2 = Entwine(Branch00=cluster_2.C, Branch01=cluster_2.P, Branch02=line, Branch03=line_2, Branch04=line_6, FlattenInputs=True)
item = ListItem(List=cluster_2.P, Index=0, Wrap=True)  # -> Item1, Item
ln = Line(StartPoint=item.Item1, EndPoint=item.Item)
move2pt = MoveToPoint(Geometry=entwine_2, PointA=item.Item, PointB=item.Item1)  # -> Moved, Vector, Transform
move2pt_2 = MoveToPoint(Geometry=entwine, PointA=item.Item, PointB=item.Item1)  # -> Moved, Vector, Transform
rotax = RotateAxis(Geometry=move2pt.Moved, Angle=degrees(180), Axis=ln)  # -> Geometry, Transform
rotax_2 = RotateAxis(Geometry=move2pt_2.Moved, Angle=degrees(180), Axis=ln)  # -> Geometry, Transform
Z = UnitZ(Factor=Slider(232, range=0..1000))
move_2 = Move(Geometry=rotax_2.Geometry, Motion=Z)  # -> Geometry, Transform
move_3 = Move(Geometry=rotax.Geometry, Motion=Z)  # -> Geometry, Transform
number_slider_2 = Slider(150, range=0..1000)
bang = ExplodeTree(Data=rotax_2.Geometry)  # -> Branch0, Branch1, Branch2, Branch3, Branch4
bang_2 = ExplodeTree(Data=rotax.Geometry)  # -> Branch0, Branch1, Branch2, Branch3, Branch4
cluster_3 = Cluster(L=split_2.Positive)  # -> C, flatten(P), flatten(V_2), flatten(V), flatten(V_3)
cluster_4 = Cluster(L=split_2.Negative)  # -> C, flatten(P), flatten(V_2), flatten(V), flatten(V_3)
rev = Reverse(Vector=reverse(bang.Branch2))
rev_2 = Reverse(Vector=reverse(bang.Branch4))
flip = FlipCurve(Curve=bang.Branch0)  # -> Curve, Flag
rev_3 = ReverseList(List=bang.Branch1)
rev_4 = Reverse(Vector=reverse(cluster_4.V_2))
rev_5 = Reverse(Vector=reverse(cluster_4.V_3))
flip_2 = FlipCurve(Curve=cluster_4.C)  # -> Curve, Flag
rev_6 = ReverseList(List=cluster_4.P)

# ---- group: Global params
move_type = ValueList({"Joint", "Linear"}, selected="Linear")
wait = Wait(Time=Slider(1, range=0..1))
tool_3 = ToolParameter(tool_2.Tool)
zone = Panel("2.0")
speed = Panel("100")

# ----
cluster_5 = Cluster_5(_0_0=rev_6, _0_1=rev_4, _0_2=rev_5, i="0", A="0")
# Strip A
cluster_6 = Cluster_5(_0_0=rev_6, _0_1=rev_4, _0_2=rev_5, i="0", A=number_slider)
cluster_7 = Cluster_4(_0_0=cluster_3.P, _0_1=cluster_3.V_2, _0_2=cluster_3.V_3, i="0", A="0")
# Strip B
cluster_8 = Cluster_4(_0_0=cluster_3.P, _0_1=cluster_3.V_2, _0_2=cluster_3.V_3, i="0", A=number_slider)

# ---- group: Step 0
cluster_9 = Cluster_3(crv=flip_2.Curve, L=rev_5, L_2=rev_4, L_3=number_slider_2)  # -> S, C
cluster_10 = Cluster_3(crv=cluster_3.C, L=cluster_3.V_3, L_2=cluster_3.V_2, L_3=number_slider_2)  # -> S, C

# ---- group: Step 1
cluster_11 = Cluster_2(S=cluster_3.P, D=cluster_3.V_2)  # -> S_2, C
cluster_12 = Cluster_2(S=rev_6, D=rev_4)  # -> S_2, C

# ----
cluster_13 = Cluster_5(_0_0=rev_3, _0_1=rev, _0_2=rev_2, i="0", A="0")
cluster_14 = Cluster_5(_0_0=rev_3, _0_1=rev, _0_2=rev_2, i="0", A=number_slider)
cluster_15 = Cluster_4(_0_0=bang_2.Branch1, _0_1=bang_2.Branch2, _0_2=bang_2.Branch4, i="0", A="0")
cluster_16 = Cluster_4(_0_0=bang_2.Branch1, _0_1=bang_2.Branch2, _0_2=bang_2.Branch4, i="0", A=number_slider)

# ---- group: Step 0
cluster_17 = Cluster_3(crv=flip.Curve, L=rev_2, L_2=rev, L_3=number_slider_2)  # -> S, C
cluster_18 = Cluster_3(crv=bang_2.Branch0, L=bang_2.Branch4, L_2=bang_2.Branch2, L_3=number_slider_2)  # -> S, C

# ---- group: Step 1
cluster_19 = Cluster_2(S=bang_2.Branch1, D=bang_2.Branch2)  # -> S_2, C
cluster_20 = Cluster_2(S=rev_3, D=rev)  # -> S_2, C

# ---- group: Node 1
pln = Plane(cluster_5)

# ---- group: Node 1 offset
pln_2 = Plane(cluster_6)

# ---- group: Node 1
pln_3 = Plane(cluster_7)

# ---- group: Node 1 offset
pln_4 = Plane(cluster_8)

# ---- group: Node 2 offset - start
addition = Addition(A="200", B=number_slider_2, C=number_slider)
# Evaluate at node length,
# plus offset distance
crv = Curve(cluster_9.C)
eval = EvaluateLength(Curve=crv, Length=addition, Normalized=False)  # -> Point, Tangent, Parameter
srf_cp = SurfaceClosestPoint(Point=eval.Point, Surface=cluster_9.S)  # -> Point, UVPoint, Distance
evalsrf = EvaluateSurface(Surface=cluster_9.S, Point=srf_cp.UVPoint)  # -> Point, Normal, UDirection, VDirection, Frame
rev_7 = Reverse(Vector=evalsrf.VDirection)
rev_8 = Reverse(Vector=evalsrf.UDirection)
pl_3 = ConstructPlane(Origin=evalsrf.Point, XAxis=rev_7, YAxis=rev_8)

addition_2 = Addition(A="200", B=number_slider_2)
# Evaluate at exact node length
crv_2 = Curve(cluster_9.C)
eval_2 = EvaluateLength(Curve=crv_2, Length=addition_2, Normalized=False)  # -> Point, Tangent, Parameter
srf_cp_2 = SurfaceClosestPoint(Point=eval_2.Point, Surface=cluster_9.S)  # -> Point, UVPoint, Distance
evalsrf_2 = EvaluateSurface(Surface=cluster_9.S, Point=srf_cp_2.UVPoint)  # -> Point, Normal, UDirection, VDirection, Frame
rev_9 = Reverse(Vector=evalsrf_2.VDirection)
rev_10 = Reverse(Vector=evalsrf_2.UDirection)
pl_4 = ConstructPlane(Origin=evalsrf_2.Point, XAxis=rev_9, YAxis=rev_10)

# ---- group: Node 1
pln_5 = Plane(cluster_13)

# ---- group: Node 1 offset
pln_6 = Plane(cluster_14)

# ---- group: Node 2 offset - start
addition_3 = Addition(A="200", B=number_slider_2, C=number_slider)
# Evaluate at node length,
# plus offset distance
crv_3 = Curve(cluster_10.C)
eval_3 = EvaluateLength(Curve=crv_3, Length=addition_3, Normalized=False)  # -> Point, Tangent, Parameter
srf_cp_3 = SurfaceClosestPoint(Point=eval_3.Point, Surface=cluster_10.S)  # -> Point, UVPoint, Distance
evalsrf_3 = EvaluateSurface(Surface=cluster_10.S, Point=srf_cp_3.UVPoint)  # -> Point, Normal, UDirection, VDirection, Frame
pl_5 = ConstructPlane(Origin=evalsrf_3.Point, XAxis=evalsrf_3.VDirection, YAxis=evalsrf_3.UDirection)

# ---- group: Node 2 - start
addition_4 = Addition(A="200", B=number_slider_2)
# Evaluate at exact node length
crv_4 = Curve(cluster_10.C)
eval_4 = EvaluateLength(Curve=crv_4, Length=addition_4, Normalized=False)  # -> Point, Tangent, Parameter
srf_cp_4 = SurfaceClosestPoint(Point=eval_4.Point, Surface=cluster_10.S)  # -> Point, UVPoint, Distance
evalsrf_4 = EvaluateSurface(Surface=cluster_10.S, Point=srf_cp_4.UVPoint)  # -> Point, Normal, UDirection, VDirection, Frame
pl_6 = ConstructPlane(Origin=evalsrf_4.Point, XAxis=evalsrf_4.VDirection, YAxis=evalsrf_4.UDirection)

# ---- group: Node 1
pln_7 = Plane(cluster_15)

# ---- group: Node 1 offset
pln_8 = Plane(cluster_16)

# ---- group: Node 2 offset - start
addition_5 = Addition(A="200", B=number_slider_2, C=number_slider)
# Evaluate at node length,
# plus offset distance
crv_5 = Curve(cluster_17.C)
eval_5 = EvaluateLength(Curve=crv_5, Length=addition_5, Normalized=False)  # -> Point, Tangent, Parameter
srf_cp_5 = SurfaceClosestPoint(Point=eval_5.Point, Surface=cluster_17.S)  # -> Point, UVPoint, Distance
evalsrf_5 = EvaluateSurface(Surface=cluster_17.S, Point=srf_cp_5.UVPoint)  # -> Point, Normal, UDirection, VDirection, Frame
rev_11 = Reverse(Vector=evalsrf_5.VDirection)
rev_12 = Reverse(Vector=evalsrf_5.UDirection)
pl_7 = ConstructPlane(Origin=evalsrf_5.Point, XAxis=rev_11, YAxis=rev_12)

# ---- group: Node 2 - start
addition_6 = Addition(A="200", B=number_slider_2)
# Evaluate at exact node length
crv_6 = Curve(cluster_18.C)
eval_6 = EvaluateLength(Curve=crv_6, Length=addition_6, Normalized=False)  # -> Point, Tangent, Parameter
srf_cp_6 = SurfaceClosestPoint(Point=eval_6.Point, Surface=cluster_18.S)  # -> Point, UVPoint, Distance
evalsrf_6 = EvaluateSurface(Surface=cluster_18.S, Point=srf_cp_6.UVPoint)  # -> Point, Normal, UDirection, VDirection, Frame
pl_8 = ConstructPlane(Origin=evalsrf_6.Point, XAxis=evalsrf_6.VDirection, YAxis=evalsrf_6.UDirection)

# ----
cluster_21 = Cluster_4(_0_0=cluster_3.P, _0_1=cluster_3.V_2, _0_2=cluster_3.V_3, i="-1", A="0")
cluster_22 = Cluster_6(_0_0=cluster_3.P, _0_1=cluster_3.V_2, _0_2=cluster_3.V_3, i="-1", A=number_slider)
cluster_23 = Cluster_5(_0_0=rev_6, _0_1=rev_4, _0_2=rev_5, i="-1", A="0")
cluster_24 = Cluster_7(_0_0=rev_6, _0_1=rev_4, _0_2=rev_5, i="-1", A=number_slider)
cluster_25 = Cluster_4(_0_0=bang_2.Branch1, _0_1=bang_2.Branch2, _0_2=bang_2.Branch4, i="-1", A="0")
cluster_26 = Cluster_6(_0_0=bang_2.Branch1, _0_1=bang_2.Branch2, _0_2=bang_2.Branch4, i="-1", A=number_slider)
cluster_27 = Cluster_5(_0_0=rev_3, _0_1=rev, _0_2=rev_2, i="-1", A="0")
cluster_28 = Cluster_7(_0_0=rev_3, _0_1=rev, _0_2=rev_2, i="-1", A=number_slider)

# ---- group: Node 2
pln_9 = Plane(cluster_21)

# ---- group: Node 2 offset - end
pln_10 = Plane(cluster_22)

# ---- group: Node 2
pln_11 = Plane(cluster_23)

# ---- group: Node 2 offset - end
pln_12 = Plane(cluster_24)

# ---- group: Node 2
pln_13 = Plane(cluster_25)

# ---- group: Node 2 offset - end
pln_14 = Plane(cluster_26)

# ---- group: Node 2
pln_15 = Plane(cluster_27)

# ---- group: Node 2 offset - end
pln_16 = Plane(cluster_28)

# ---- group: Strip A - before bending
merge = Merge(Data1=flatten(pln_2), Data2=flatten(pl_3))
crv_7 = Curve(cluster_9.C)
ptstrimcrv = PointsTrimCurve(Curve=crv_7, Points=merge, Flip=True)  # -> Trimmed, SubDomains, Intersected
crv_8 = Curve(ptstrimcrv.Trimmed)

# ---- group: Strip A - after bending
merge_2 = Merge(Data1=flatten(pln_2), Data2=flatten(pln_12))
crv_9 = Curve(cluster_12.C)
ptstrimcrv_2 = PointsTrimCurve(Curve=crv_9, Points=merge_2, Flip=True)  # -> Trimmed, SubDomains, Intersected
crv_10 = Curve(ptstrimcrv_2.Trimmed)

# ---- group: Strip B - before bending
merge_3 = Merge(Data1=flatten(pln_4), Data2=flatten(pl_6))
crv_11 = Curve(cluster_10.C)
ptstrimcrv_3 = PointsTrimCurve(Curve=crv_11, Points=merge_3, Flip=True)  # -> Trimmed, SubDomains, Intersected
crv_12 = Curve(ptstrimcrv_3.Trimmed)

# ---- group: Strip B - after bending
merge_4 = Merge(Data1=flatten(pln_4), Data2=flatten(pln_9))
crv_13 = Curve(cluster_11.C)
ptstrimcrv_4 = PointsTrimCurve(Curve=crv_13, Points=merge_4, Flip=True)  # -> Trimmed, SubDomains, Intersected
crv_14 = Curve(ptstrimcrv_4.Trimmed)

# ---- group: Strip A - before bending
merge_5 = Merge(Data1=flatten(pln_6), Data2=flatten(pl_7))
crv_15 = Curve(cluster_17.C)
ptstrimcrv_5 = PointsTrimCurve(Curve=crv_15, Points=merge_5, Flip=True)  # -> Trimmed, SubDomains, Intersected
crv_16 = Curve(ptstrimcrv_5.Trimmed)

# ---- group: Strip A - after bending
merge_6 = Merge(Data1=flatten(pln_6), Data2=flatten(pln_16))
crv_17 = Curve(cluster_20.C)
ptstrimcrv_6 = PointsTrimCurve(Curve=crv_17, Points=merge_6, Flip=True)  # -> Trimmed, SubDomains, Intersected
crv_18 = Curve(ptstrimcrv_6.Trimmed)

# ---- group: Strip B - before bending
merge_7 = Merge(Data1=flatten(pln_8), Data2=flatten(pl_8))
crv_19 = Curve(cluster_18.C)
ptstrimcrv_7 = PointsTrimCurve(Curve=crv_19, Points=merge_7, Flip=True)  # -> Trimmed, SubDomains, Intersected
crv_20 = Curve(ptstrimcrv_7.Trimmed)

# ---- group: Strip B - after bending
merge_8 = Merge(Data1=flatten(pln_8), Data2=flatten(pln_13))
crv_21 = Curve(cluster_19.C)
ptstrimcrv_8 = PointsTrimCurve(Curve=crv_21, Points=merge_8, Flip=True)  # -> Trimmed, SubDomains, Intersected
crv_22 = Curve(ptstrimcrv_8.Trimmed)

# ----
cluster_29 = Cluster_8(A=crv_8, B=crv_10, A_2=pl_3, B_2=pln_12)
# Interp planes to approximate bending path.
# 1. trim start and end curves
# 2. interp curves
# 3. interp planes along curve ends
# 4. extend each curve to correct curve length
cluster_30 = Cluster_8(A=crv_12, B=crv_14, A_2=pl_6, B_2=pln_9)
cluster_31 = Cluster_8(A=crv_16, B=crv_18, A_2=pl_7, B_2=pln_16)

pln_17 = Plane(pl_8)
flippln = FlipPlane(Plane=pln_17, FlipX=True, FlipY=True, FlipZ=False)  # -> Flipped, R
list_2 = ValueList({"Joint", "Linear"}, selected="Joint")
list_3 = ValueList({"One": 1, "Two": 2, "Three": 2² - 1, "Four": Sqrt(16)}, selected="Four")
target = CreateTarget(Plane=flippln.Flipped, RobConf=list_3, Motion=list_2, Tool=tool_3, Speed=speed, IsCartesian=True)

pln_18 = Plane(pln_14)
flippln_2 = FlipPlane(Plane=pln_18, FlipX=True, FlipY=True, FlipZ=True)  # -> Flipped, R
list_4 = ValueList({"Joint", "Linear"}, selected="Joint")
list_5 = ValueList({"One": 1, "Two": 2, "Three": 2² - 1, "Four": Sqrt(16)}, selected="Four")
target_2 = CreateTarget(Plane=flippln_2.Flipped, RobConf=list_5, Motion=list_4, Tool=tool_3, Speed=speed, IsCartesian=True)

pln_19 = Plane(pl_7)

# ---- group: Robot B - pose 2 - grab strip A
pln_20 = Plane(pln_10)
flippln_3 = FlipPlane(Plane=pln_20, FlipX=False, FlipY=True, FlipZ=False)  # -> Flipped, R
list_6 = ValueList({"Joint", "Linear"}, selected="Joint")
list_7 = ValueList({"One": 1, "Two": 2, "Three": 2² - 1, "Four": Sqrt(16)}, selected="Four")
target_3 = CreateTarget(Plane=flippln_3.Flipped, RobConf=list_7, Motion=list_6, Tool=tool_3, Speed=speed, IsCartesian=True)

# ---- group: Robot A - pose 4 - grab strip B / Robot A - pose 1
pln_21 = Plane(pl_3)
list_8 = ValueList({"One": 1, "Two": 2, "Three": 2² - 1, "Four": Sqrt(16)}, selected="Four")
list_9 = ValueList({"Joint", "Linear"}, selected="Joint")
target_4 = CreateTarget(Plane=pln_21, RobConf=list_8, Motion=list_9, Tool=tool_3, Speed=speed, IsCartesian=True)

# ---- group: Robot A - pose 1 / Robot A - pose 1 - place strip A
pln_22 = Plane(pln_2)
list_10 = ValueList({"Joint", "Linear"}, selected="Joint")
list_11 = ValueList({"One": 1, "Two": 2, "Three": 2² - 1, "Four": Sqrt(16)}, selected="Four")
target_5 = CreateTarget(Plane=pln_22, RobConf=list_11, Motion=list_10, Tool=tool_3, Speed=speed, IsCartesian=True)

# ----
# Interp planes to approximate bending path.
# 1. trim start and end curves
# 2. interp curves
# 3. interp planes along curve ends
# 4. extend each curve to correct curve length
cluster_32 = Cluster_8(A=crv_20, B=crv_22, A_2=pl_8, B_2=pln_13)

# ---- group: Robot A - pose 1 / Robot B - pose 1 - place strip B
pln_23 = Plane(pln_4)
list_12 = ValueList({"Joint", "Linear"}, selected="Joint")
list_13 = ValueList({"One": 1, "Two": 2, "Three": 2² - 1, "Four": Sqrt(16)}, selected="Four")
target_6 = CreateTarget(Plane=pln_23, RobConf=list_13, Motion=list_12, Tool=tool_3, Speed=speed, IsCartesian=True)

# ----
geo = Geometry(cluster_29)

# ---- group: Robot A - pose 5 - bend strip B / Robot A - pose 1
pln_24 = Plane(geo)
list_14 = ValueList({"One": 1, "Two": 2, "Three": 2² - 1, "Four": Sqrt(16)}, selected="Four")
list_15 = ValueList({"Joint", "Linear"}, selected="Linear")
target_7 = CreateTarget(Plane=pln_24, RobConf=list_14, Motion=list_15, Tool=tool_3, Speed=speed, IsCartesian=True)

# ----
geo_2 = Geometry(cluster_30)

# ---- group: Home
# A home position should be set
# using joint rotation values. This is
# the only way to unambiguously
# define a robot pose.
panel_2 = Panel("pi/2,pi/4,0,0,0,0")
target_8 = CreateTarget(Joints=panel_2, Tool=tool_3, Speed=speed, IsCartesian=False)

# ----
geo_3 = Geometry(cluster_31)
pln_25 = Plane(geo_3)
geo_4 = Geometry(cluster_32)

pln_26 = Plane(geo_4)
flippln_4 = FlipPlane(Plane=pln_26, FlipX=True, FlipY=True, FlipZ=False)  # -> Flipped, R
list_16 = ValueList({"Joint", "Linear"}, selected="Joint")
list_17 = ValueList({"One": 1, "Two": 2, "Three": 2² - 1, "Four": Sqrt(16)}, selected="Four")
target_9 = CreateTarget(Plane=flippln_4.Flipped, RobConf=list_17, Motion=list_16, Tool=tool_3, Speed=speed, IsCartesian=True)

# ---- group: create program
program_name = Panel("lacing_a")
merge_9 = Merge(Data1=target_8, Data2=target_6, Data3=target_3, Data4=target, Data5=target_9)  # -> flatten(Result)
program = CreateProgram(Name=program_name, RobotSystem=load_robot, Targets1=merge_9, StepSize=1)  # -> Program, Code, Duration, Warnings, Errors

# ----
panel_3 = Panel(program.Warnings)
panel_4 = Panel(program.Errors)
panel_5 = Panel("255,105, 180")

# ----
# 2. Robot B place Strip 2
# Load Strip (open gripper, locate strip, close gripper)
# Glue Strips 1 and 2
pln_27 = Plane(pln_4)

# ----
# Planes for Bigon 1
# 1. Robot A place Strip 1
# Load Strip (open gripper, locate strip, close gripper)
pln_28 = Plane(pln_2)

# ----
# Planes for Bigon 2
# 1. Robot B grab bottom of Strip 2
# Open gripper, move to new plane, close gripper
# Will need a jig to hold the strips
pln_29 = Plane(flippln.Flipped)

# ----
# 2. Robot B bend Strip 2
pln_30 = Plane(flippln_4.Flipped)

# ----
# 4. Robot A grab Strip 1
# Open gripper, move to new plane, close gripper
pln_31 = Plane(pl_7)

# ----
# 5. Robot A bend Strip 1
# Glue Strips 1 and 2
pln_32 = Plane(geo_3)

# ----
# 6. Robot A grab Strip 1
# Open gripper, move to new plane, close gripper
pln_33 = Plane(pl_3)

# ----
# 7. Robot A bend Strip 1
# Glue Strips 1 and 2
pln_34 = Plane(geo)

# ----
# 3. Robot A grab Strip 2
# Open gripper, move to new plane, close gripper
pln_35 = Plane(flippln_2.Flipped)

# ----
# 5. Robot B grab Strip 2
# Open gripper, move to new plane, close gripper
pln_36 = Plane(pln_20)

material = CreateMaterial(
    Diffuse=RGB(105, 115, 255),
    Specular=RGB(255, 255, 255),
    Emission=RGB(0, 0, 0),
    Transparency=Slider(0.2, range=0..1),
    Shine=0)
material_2 = CreateMaterial(
    Diffuse="255,105, 180",
    Specular=RGB(255, 255, 255),
    Emission=RGB(0, 0, 0),
    Transparency=Slider(0.2, range=0..1),
    Shine=0)
sim = ProgramSimulation(Program=program.Program, Time=Slider(1, range=0..1), Normalized=True)  # -> SystemMeshes, JointRotations, Plane, Index, Time, Program, Errors
preview = CustomPreview(Geometry=sim.SystemMeshes, Material=material)

# ---- group: Robot A - pose 2 - grab top of strip B / Robot A - pose 1
pln_37 = Plane(pl_6)
list_18 = ValueList({"Joint", "Linear"}, selected="Joint")
list_19 = ValueList({"One": 1, "Two": 2, "Three": 2² - 1, "Four": Sqrt(16)}, selected="Four")

# ---- group: Robot A - pose 2 - grab top of strip B
flippln_5 = FlipPlane(Plane=pln_37, FlipX=True, FlipY=True, FlipZ=False)  # -> Flipped, R

# ---- group: Robot A - pose 2 - grab top of strip B / Robot A - pose 1 (continued)
target_10 = CreateTarget(Plane=flippln_5.Flipped, RobConf=list_19, Motion=list_18, Tool=tool_3, Speed=speed, IsCartesian=True)

# ----
# 3. Robot A grab top of Strip 2
# Open gripper, move to new plane, close gripper
# Will need a jig to hold the strips
pln_38 = Plane(flippln_5.Flipped)

# ---- group: Robot A - pose 3 - bend strip A / Robot A - pose 1
pln_39 = Plane(geo_2)
list_20 = ValueList({"Joint", "Linear"}, selected="Linear")
list_21 = ValueList({"One": 1, "Two": 2, "Three": 2² - 1, "Four": Sqrt(16)}, selected="Four")

# ---- group: Robot A - pose 3 - bend strip A
flippln_6 = FlipPlane(Plane=pln_39, FlipX=True, FlipY=True, FlipZ=False)  # -> Flipped, R

# ---- group: Robot A - pose 3 - bend strip A / Robot A - pose 1 (continued)
target_11 = CreateTarget(Plane=flippln_6.Flipped, RobConf=list_21, Motion=list_20, Tool=tool_3, Speed=speed, IsCartesian=True)

# ---- group: create program
program_name_2 = Panel("lacing_b")
merge_10 = Merge(Data1=target_8, Data2=target_5, Data3=target_10, Data4=target_11, Data5=target_4, Data6=target_7)  # -> flatten(Result)
program_2 = CreateProgram(Name=program_name_2, RobotSystem=load_robot_2, Targets1=merge_10, StepSize=1)  # -> Program, Code, Duration, Warnings, Errors

# ----
# 4. Robot A bend Strip 2
pln_40 = Plane(flippln_6.Flipped)

panel_6 = Panel(program_2.Warnings)
panel_7 = Panel(program_2.Errors)
sim_2 = ProgramSimulation(Program=program_2.Program, Time=Slider(1, range=0..1), Normalized=True)  # -> SystemMeshes, JointRotations, Plane, Index, Time, Program, Errors
# Right click and select 'open controls' to
# preview the tool path, or move the slider.
preview_2 = CustomPreview(Geometry=sim_2.SystemMeshes, Material=material_2)

# ==== cluster Cluster
L = ClusterInput()
item = ListItem(List=L, Index=0, Wrap=True)  # -> Item, Item1, Item2, Item3, Item4, Item5, Item6, Item7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
number_slider = Slider(5, range=0..10)
pt = ConstructPoint(XCoordinate=item.Item5, YCoordinate=item.Item6, ZCoordinate=item.Item7)
vec = VectorXYZ(XComponent=item.Item8, YComponent=item.Item9, ZComponent=item.Item10)  # -> Vector, Length
vec_2 = VectorXYZ(XComponent=item.Item11, YComponent=item.Item12, ZComponent=item.Item13)  # -> Vector, Length
vec_3 = VectorXYZ(XComponent=item.Item14, YComponent=item.Item15, ZComponent=item.Item16)  # -> Vector, Length
division = Division(A=item.Item1, B="200")
vdis = VectorDisplay(Anchor=pt, Vector=vec.Vector)
vdis_2 = VectorDisplay(Anchor=pt, Vector=vec_2.Vector)
intcrv = Interpolate(Vertices=flatten(pt), Degree=3, Periodic=False, KnotStyle=1)  # -> Curve, Length, Domain
vdis_3 = VectorDisplay(Anchor=pt, Vector=vec_3.Vector)
amp = Amplitude(Vector=vec_2.Vector, Amplitude=number_slider)
amp_2 = Amplitude(Vector=vec.Vector, Amplitude=number_slider)
amp_3 = Amplitude(Vector=vec_3.Vector, Amplitude=number_slider)
eval = EvaluateCurve(Curve=reparameterize(intcrv.Curve), Parameter=division)  # -> Point, Tangent, Angle
V = ClusterOutput(amp)
V_2 = ClusterOutput(amp_2)
V_3 = ClusterOutput(amp_3)
P = ClusterOutput(eval.Point)
C = ClusterOutput(intcrv.Curve)

# ==== cluster Cluster_2
number_slider = Slider(5, range=0..10)
S = ClusterInput()
D = ClusterInput()
neg = Negative(Value=number_slider)
line = LineSDL(Start=S, Direction=D, Length=graft([number_slider, neg]))  # -> flatten(Line)
intcrv = Interpolate(Vertices=S, Degree=3, Periodic=False, KnotStyle=1)  # -> Curve, Length, Domain
join = JoinCurves(Curves=line, Preserve=False)
item = ListItem(List=D, Index=0, Wrap=True)  # -> Item1, Item
ext = ExtendCurve(Curve=intcrv.Curve, Type=0, Start=Slider(150, range=0..1000), End=Slider(300, range=0..1000))
item_2 = ListItem(List=join, Index=0, Wrap=True)
end = EndPoints(Curve=ext)  # -> Start, End
line_2 = LineSDL(Start=end.End, Direction=item.Item1, Length=[number_slider, neg])  # -> flatten(Line)
line_3 = LineSDL(Start=end.Start, Direction=item.Item, Length=[number_slider, neg])  # -> flatten(Line)
join_2 = JoinCurves(Curves=line_2, Preserve=False)
join_3 = JoinCurves(Curves=line_3, Preserve=False)
ins = InsertItems(List=join, Item=join_2, Indices="-1", Wrap=True)
ins_2 = InsertItems(List=ins, Item=join_3, Indices="0", Wrap=True)
swp1 = Sweep1(Rail=ext, Sections=ins_2, Miter=1)
S_2 = ClusterOutput(swp1)
C = ClusterOutput(ext)

# ==== cluster Cluster_3
crv = ClusterInput()
L = ClusterInput()
L_2 = ClusterInput()
crv_2 = Curve(crv)
L_3 = ClusterInput()
number_slider = Slider(5, range=0..10)
end = EndPoints(Curve=crv_2)  # -> Start, End
item = ListItem(List=L_2, Index=0, Wrap=True)
item_2 = ListItem(List=L, Index=0, Wrap=True)
rev = Reverse(Vector=item_2)
neg = Negative(Value=number_slider)
line = LineSDL(Start=end.Start, Direction=rev, Length=L_3)
ext = ExtendCurve(Curve=line, Type=0, Start=Slider(400, range=0..1000), End=0)
end_2 = EndPoints(Curve=ext)  # -> Start, End
line_2 = LineSDL(Start=end_2.Start, Direction=item, Length=[neg, number_slider])
join = JoinCurves(Curves=line_2, Preserve=False)
swp1 = Sweep1(Rail=ext, Sections=join, Miter=1)
crv_3 = Curve(ext)
flip = FlipCurve(Curve=crv_3)  # -> Curve, Flag
S = ClusterOutput(swp1)
C = ClusterOutput(flip.Curve)

# ==== cluster Cluster_4
_0_2 = ClusterInput()
_0_0 = ClusterInput()
_0_1 = ClusterInput()
A = ClusterInput()
i = ClusterInput()
entwine = Entwine(Branch00=_0_0, Branch01=_0_1, Branch02=_0_2, FlattenInputs=True)
geo = Geometry(_0_0)
item = ListItem(List=entwine, Index=i, Wrap=True)
bang = ExplodeTree(Data=item)  # -> Branch0, Branch1, Branch2
vdis = VectorDisplay(Anchor=bang.Branch0, Vector=bang.Branch2)
vdis_2 = VectorDisplay(Anchor=bang.Branch0, Vector=bang.Branch1)
pl = ConstructPlane(Origin=bang.Branch0, XAxis=bang.Branch1, YAxis=bang.Branch2)
amp = Amplitude(Vector=bang.Branch2, Amplitude=A)
move = Move(Geometry=pl, Motion=expr("-x", amp))  # -> Geometry, Transform
geo_2 = Geometry(pl)
flippln = FlipPlane(Plane=move.Geometry, FlipX=False, FlipY=True, FlipZ=False)  # -> Flipped, R
F = ClusterOutput(flippln.Flipped)

# ==== cluster Cluster_5
_0_2 = ClusterInput()
_0_0 = ClusterInput()
_0_1 = ClusterInput()
A = ClusterInput()
i = ClusterInput()
entwine = Entwine(Branch00=_0_0, Branch01=_0_1, Branch02=_0_2, FlattenInputs=True)
geo = Geometry(_0_0)
item = ListItem(List=entwine, Index=i, Wrap=True)
bang = ExplodeTree(Data=item)  # -> Branch0, Branch1, Branch2
vdis = VectorDisplay(Anchor=bang.Branch0, Vector=bang.Branch2)
vdis_2 = VectorDisplay(Anchor=bang.Branch0, Vector=bang.Branch1)
pl = ConstructPlane(Origin=bang.Branch0, XAxis=bang.Branch1, YAxis=bang.Branch2)
amp = Amplitude(Vector=bang.Branch2, Amplitude=A)
move = Move(Geometry=pl, Motion=expr("-x", amp))  # -> Geometry, Transform
geo_2 = Geometry(pl)
flippln = FlipPlane(Plane=move.Geometry, FlipX=True, FlipY=False, FlipZ=False)  # -> Flipped, R
F = ClusterOutput(flippln.Flipped)
geo_3 = Geometry(flippln.Flipped)

# ==== cluster Cluster_6
_0_2 = ClusterInput()
_0_0 = ClusterInput()
_0_1 = ClusterInput()
A = ClusterInput()
i = ClusterInput()
entwine = Entwine(Branch00=_0_0, Branch01=_0_1, Branch02=_0_2, FlattenInputs=True)
geo = Geometry(_0_0)
item = ListItem(List=entwine, Index=i, Wrap=True)
bang = ExplodeTree(Data=item)  # -> Branch0, Branch1, Branch2
vdis = VectorDisplay(Anchor=bang.Branch0, Vector=bang.Branch2)
vdis_2 = VectorDisplay(Anchor=bang.Branch0, Vector=bang.Branch1)
pl = ConstructPlane(Origin=bang.Branch0, XAxis=bang.Branch1, YAxis=bang.Branch2)
amp = Amplitude(Vector=bang.Branch2, Amplitude=A)
geo_2 = Geometry(pl)
move = Move(Geometry=pl, Motion=amp)  # -> Geometry, Transform
flippln = FlipPlane(Plane=move.Geometry, FlipX=False, FlipY=True, FlipZ=False)  # -> Flipped, R
F = ClusterOutput(flippln.Flipped)

# ==== cluster Cluster_7
_0_2 = ClusterInput()
_0_0 = ClusterInput()
_0_1 = ClusterInput()
A = ClusterInput()
i = ClusterInput()
entwine = Entwine(Branch00=_0_0, Branch01=_0_1, Branch02=_0_2, FlattenInputs=True)
geo = Geometry(_0_0)
item = ListItem(List=entwine, Index=i, Wrap=True)
bang = ExplodeTree(Data=item)  # -> Branch0, Branch1, Branch2
vdis = VectorDisplay(Anchor=bang.Branch0, Vector=bang.Branch2)
vdis_2 = VectorDisplay(Anchor=bang.Branch0, Vector=bang.Branch1)
pl = ConstructPlane(Origin=bang.Branch0, XAxis=bang.Branch1, YAxis=bang.Branch2)
amp = Amplitude(Vector=bang.Branch2, Amplitude=A)
geo_2 = Geometry(pl)
move = Move(Geometry=pl, Motion=amp)  # -> Geometry, Transform
flippln = FlipPlane(Plane=move.Geometry, FlipX=True, FlipY=False, FlipZ=False)  # -> Flipped, R
F = ClusterOutput(flippln.Flipped)
geo_3 = Geometry(flippln.Flipped)

# ==== cluster Cluster_8
A = ClusterInput()
B = ClusterInput()
range = Range(Domain=Domain(0, 1), Steps=Slider(10, range=0..10))
crv = Curve(B)
crv_2 = Curve(A)
twn2crvs = TweenTwoCurves(CurveA=A, CurveB=B, Factor=range, Refit=0, PointSample=0)
item = ListItem(List=twn2crvs, Index=0, Wrap=True)
twn2crvs_2 = TweenTwoCurves(CurveA=A, CurveB=B, Factor=range, Refit=0, PointSample=0)
len = Length(Curve=item)
len_2 = Length(Curve=twn2crvs)
subtraction = Subtraction(A=len, B=len_2)
ext = ExtendCurve(Curve=twn2crvs, Type=0, Start="0", End=subtraction)
len_3 = Length(Curve=ext)
end = EndPoints(Curve=ext)  # -> Start, End
intcrv = Interpolate(Vertices=end.End, Degree=3, Periodic=False, KnotStyle=1)  # -> Curve, Length, Domain
A_2 = ClusterInput()
B_2 = ClusterInput()
panel = Panel(len_3)
twn2plnscrv = TweenTwoPlanesOnCurve(PlaneA=A_2, PlaneB=B_2, Curve=intcrv.Curve, Factor=range, Weighted=False, Quaternion=True)
T = ClusterOutput(twn2plnscrv)
