# Grasshopper definition robotic_lacing_test_functions.ghx (Grasshopper 1.0.7)
# plug-ins: Robots, Pufferfish

reload = Button()
py = PythonScript(reload=reload)
# ---------- py: Python ----------
from compas_rhino.utilities.misc import get_tolerance
from compas_rhino.utilities.misc import unload_modules

from compas_ghpython import unload_modules
unload_modules("compas")
unload_modules("compas_fab")
unload_modules("roslibpy")
unload_modules("abb_communication")
unload_modules("robotic_lacing")
# ---------- end py ----------

# ----
# Move Bigon
move_y = Slider(-100, range=-500..1000)
move_x = Slider(0, range=-1000..1000)
move_z = Slider(400, range=0..1000)

# ----
# Strip Length
# Offset from Node
# Scale
number_slider = Slider(150, range=-100..200)
number_slider_2 = Slider(30, range=0..50)

addition = Addition(A="200", B=number_slider)
subtraction = Subtraction(A=addition, B=number_slider_2)

# ----
# Local path to robotic_lacing repo
panel = Panel("\robotic_lacing\gh\data\Bigon80degree.dat")
panel_2 = Panel("C:\Users\lkram\Documents\GitHub")
concat = Concatenate(FragmentA="C:\Users\laurendreier\repos", FragmentB=panel)
file = ReadFile(File=concat, PerLineParse=True)
split = TextSplit(Text=file, Separators=",")
multiplication = Multiplication(A=split, B="200")
split_2 = SplitTree(Data=simplify(multiplication), Masks=flatten("{(0 to 40)}"))  # -> Positive, Negative
addition_2 = Addition(A=number_slider, B=number_slider_2)
addition_3 = Addition(A=subtraction, B=number_slider_2, C=number_slider_2)

# ----
# Strip Geometry
cluster = Cluster(L=split_2.Positive, F=move_z, F_2=move_x, F_3=move_y)  # -> crv_2, flatten(pt_3), flatten(vec_7), flatten(vec_8), flatten(vec_9)
cluster_2 = Cluster(L=split_2.Negative, F=move_z, F_2=move_x, F_3=move_y)  # -> crv_2, flatten(pt_3), flatten(vec_7), flatten(vec_8), flatten(vec_9)
rev = Reverse(Vector=reverse(cluster_2.vec_7))
rev_2 = Reverse(Vector=reverse(cluster_2.vec_9))
flip = FlipCurve(Curve=cluster_2.crv_2)  # -> Curve, Flag
rev_3 = ReverseList(List=cluster_2.pt_3)

# ----
# Straight
# Strips
cluster_3 = Cluster_3(crv=cluster.crv_2, L=cluster.vec_9, L_2=cluster.vec_7, L_3=number_slider)  # -> S, C
cluster_4 = Cluster_3(crv=flip.Curve, L=rev_2, L_2=rev, L_3=number_slider)  # -> S, C

# ----
# Bent
# Strips
cluster_5 = Cluster_2(S=cluster.pt_3, D=cluster.vec_7)  # -> S_2, C
cluster_6 = Cluster_2(S=rev_3, D=rev)  # -> S_2, C

# ----
# Straight Strips Start Point
cluster_7 = Cluster_5(C=cluster_3.C, L=addition_2, S=cluster_3.S)  # -> pl_2, i
cluster_8 = Cluster_5(C=cluster_4.C, L=addition_2, S=cluster_4.S)  # -> pl_2, i
flippln = FlipPlane(Plane=cluster_7.pl_2, FlipX=False, FlipY=False, FlipZ=False)  # -> Flipped, R
flippln_2 = FlipPlane(Plane=cluster_8.pl_2, FlipX=True, FlipY=True, FlipZ=False)  # -> Flipped, R

# ----
# Bent Strips Start Point
cluster_9 = Cluster_5(C=cluster_6.C, L=addition_2, S=cluster_6.S_2)  # -> pl_2, i
cluster_10 = Cluster_5(C=cluster_5.C, L=addition_2, S=cluster_5.S_2)  # -> pl_2, i
flippln_3 = FlipPlane(Plane=cluster_9.pl_2, FlipX=True, FlipY=False, FlipZ=False)  # -> Flipped, R
flippln_4 = FlipPlane(Plane=cluster_10.pl_2, FlipX=False, FlipY=False, FlipZ=False)  # -> Flipped, R

# ----
# Straight Strips End Point
cluster_11 = Cluster_5(C=cluster_3.C, L=subtraction, S=cluster_3.S)  # -> pl_2, i
cluster_12 = Cluster_5(C=cluster_4.C, L=subtraction, S=cluster_4.S)  # -> pl_2, i
flippln_5 = FlipPlane(Plane=cluster_12.pl_2, FlipX=False, FlipY=True, FlipZ=False)  # -> Flipped, R
flippln_6 = FlipPlane(Plane=cluster_11.pl_2, FlipX=True, FlipY=True, FlipZ=False)  # -> Flipped, R

# ----
# Bent Strips End Point
cluster_13 = Cluster_5(C=cluster_5.C, L=subtraction, S=cluster_5.S_2)  # -> pl_2, i
cluster_14 = Cluster_5(C=cluster_6.C, L=subtraction, S=cluster_6.S_2)  # -> pl_2, i
flippln_7 = FlipPlane(Plane=cluster_13.pl_2, FlipX=False, FlipY=False, FlipZ=False)  # -> Flipped, R
flippln_8 = FlipPlane(Plane=cluster_14.pl_2, FlipX=True, FlipY=False, FlipZ=False)  # -> Flipped, R

# ----
# Bent Strips End Point Offset
cluster_15 = Cluster_5(C=cluster_5.C, L=addition_3, S=cluster_5.S_2)  # -> pl_2, i
cluster_16 = Cluster_5(C=cluster_6.C, L=addition_3, S=cluster_6.S_2)  # -> pl_2, i
flippln_9 = FlipPlane(Plane=cluster_15.pl_2, FlipX=True, FlipY=True, FlipZ=False)  # -> Flipped, R
flippln_10 = FlipPlane(Plane=cluster_16.pl_2, FlipX=False, FlipY=False, FlipZ=False)  # -> Flipped, R

flippln_11 = FlipPlane(Plane=cluster_8.pl_2, FlipX=False, FlipY=True, FlipZ=False)  # -> Flipped, R
flippln_12 = FlipPlane(Plane=cluster_7.pl_2, FlipX=True, FlipY=True, FlipZ=False)  # -> Flipped, R

# ----
# Strip A CL before and after
merge = Merge(Data1=flatten(flippln.Flipped), Data2=flatten(flippln_6.Flipped))
ptstrimcrv = PointsTrimCurve(Curve=cluster_3.C, Points=merge, Flip=True)  # -> Trimmed, SubDomains, Intersected
crv = Curve(ptstrimcrv.Trimmed)

merge_2 = Merge(Data1=flatten(flippln.Flipped), Data2=flatten(flippln_7.Flipped))
ptstrimcrv_2 = PointsTrimCurve(Curve=cluster_5.C, Points=merge_2, Flip=True)  # -> Trimmed, SubDomains, Intersected
crv_2 = Curve(ptstrimcrv_2.Trimmed)

# ----
# Strip B CL before and after
merge_3 = Merge(Data1=flatten(flippln_2.Flipped), Data2=flatten(flippln_5.Flipped))
ptstrimcrv_3 = PointsTrimCurve(Curve=cluster_4.C, Points=merge_3, Flip=True)  # -> Trimmed, SubDomains, Intersected
crv_3 = Curve(ptstrimcrv_3.Trimmed)

merge_4 = Merge(Data1=flatten(flippln_2.Flipped), Data2=flatten(flippln_8.Flipped))
ptstrimcrv_4 = PointsTrimCurve(Curve=cluster_6.C, Points=merge_4, Flip=True)  # -> Trimmed, SubDomains, Intersected
crv_4 = Curve(ptstrimcrv_4.Trimmed)

# ----
# Bending Planes
cluster_17 = Cluster_4(A=crv, B=crv_2, A_2=flippln_6.Flipped, B_2=flippln_7.Flipped)
cluster_18 = Cluster_4(A=crv_3, B=crv_4, A_2=flippln_5.Flipped, B_2=flippln_8.Flipped)
geo = Geometry(cluster_17)
geo_2 = Geometry(cluster_18)

# ----
# Move Bigon
number_slider_3 = Slider(0, range=0..1000)
vec = VectorXYZ(XComponent=number_slider_3, YComponent=Slider(330, range=0..1000), ZComponent=Slider(200, range=-200..1000))  # -> Vector, Length

# ----
# Move Bigon
number_slider_4 = Slider(0, range=0..1000)
vec_2 = VectorXYZ(XComponent=number_slider_4, YComponent=Slider(250, range=0..1000), ZComponent=Slider(150, range=-200..1000))  # -> Vector, Length

entwine = Entwine(Branch04=cluster_5.C, Branch05=cluster_5.S_2, Branch06=cluster_6.C, Branch07=cluster_6.S_2, FlattenInputs=True)
ccx = CurveCurve(CurveA=cluster_5.C, CurveB=cluster_6.C)  # -> Points, ParamsA, ParamsB
item = ListItem(List=ccx.Points, Index=0, Wrap=True)  # -> Item, Item1
ln = Line(StartPoint=item.Item, EndPoint=item.Item1)
move = Move(Geometry=ln, Motion=vec.Vector)  # -> Geometry, Transform
move_2 = Move(Geometry=entwine, Motion=vec.Vector)  # -> Geometry, Transform
move2pt = MoveToPoint(Geometry=entwine, PointA=item.Item, PointB=item.Item1)  # -> Moved, Vector, Transform
curvepoint = PointOnCurve(move.Geometry, parameter=0.5)
rotate = Rotate(Geometry=move.Geometry, Angle=1.570796327, Plane=curvepoint)  # -> Geometry, Transform
rotax = RotateAxis(Geometry=entwine, Angle=degrees(90), Axis=rotate.Geometry)  # -> Geometry, Transform
xz = XZPlane(Origin=curvepoint)
yz = YZPlane(Origin=item.Item)
rotate_2 = Rotate(Geometry=move_2.Geometry, Angle=degrees(45), Plane=curvepoint)  # -> Geometry, Transform
rotate_3 = Rotate(Geometry=rotate_2.Geometry, Angle=degrees(-90), Plane=curvepoint)  # -> Geometry, Transform
rotax_2 = RotateAxis(Geometry=rotate_2.Geometry, Angle=degrees(90), Axis=rotate.Geometry)  # -> Geometry, Transform
rotax_3 = RotateAxis(Geometry=rotate_3.Geometry, Angle=degrees(90), Axis=rotate.Geometry)  # -> Geometry, Transform
bang = ExplodeTree(Data=rotax_3.Geometry)  # -> Branch0, Branch1, Branch2, Branch3, Branch4, Branch5, Branch6, Branch7
bang_2 = ExplodeTree(Data=rotax_2.Geometry)  # -> Branch0, Branch1, Branch2, Branch3, Branch4, Branch5, Branch6, Branch7

# ----
# Bigon 1
# 0. Robot A place Strip 1
# Load Strip (open gripper, locate strip, close gripper)
pln = Plane(flippln_4.Flipped)
target = CreateTarget(Plane=pln, IsCartesian=True)

# ----
# 1. Robot B place Strip 2
# Load Strip (open gripper, locate strip, close gripper)
# Glue Strips 1 and 2
pln_2 = Plane(flippln_3.Flipped)
target_2 = CreateTarget(Plane=pln_2, IsCartesian=True)

# ----
# 2. Robot A grab top of Strip 2
# Open gripper, move to new plane, close gripper
pln_3 = Plane(flippln_6.Flipped)
target_3 = CreateTarget(Plane=pln_3, IsCartesian=True)

# ----
# 5. Robot A bend Strip 1
# Glue Strips 1 and 2
pln_4 = Plane(geo_2)
target_4 = CreateTarget(Plane=pln_4, IsCartesian=True)

# ----
# 3. Robot A bend Strip 2
pln_5 = Plane(geo)
target_5 = CreateTarget(Plane=pln_5, IsCartesian=True)

# ----
# 4. Robot A grab Strip 1
# Open gripper, move to new plane, close gripper
pln_6 = Plane(flippln_5.Flipped)
target_6 = CreateTarget(Plane=pln_6, IsCartesian=True)

yz_2 = YZPlane(Origin=curvepoint)

# ----
# Rotate 90 YZ
rotate_4 = Rotate(Geometry=rotax_3.Geometry, Angle=degrees(90), Plane=yz_2)  # -> Geometry, Transform
rotate_5 = Rotate(Geometry=rotax_2.Geometry, Angle=degrees(90), Plane=yz_2)  # -> Geometry, Transform

# ----
# Rotate 45
rotate_6 = Rotate(Geometry=rotax_3.Geometry, Angle=degrees(45), Plane=xz)  # -> Geometry, Transform
rotate_7 = Rotate(Geometry=rotax_2.Geometry, Angle=degrees(45), Plane=xz)  # -> Geometry, Transform

# ----
# Rotate 65
rotate_8 = Rotate(Geometry=rotax_3.Geometry, Angle=degrees(45), Plane=xz)  # -> Geometry, Transform
rotate_9 = Rotate(Geometry=rotax_2.Geometry, Angle=degrees(45), Plane=xz)  # -> Geometry, Transform

filter = StreamFilter(Gate=Slider(6, range=0..15), Stream0=pln, Stream1=pln_2, Stream2=pln_3, Stream3=pln_5, Stream4=pln_6, Stream5=pln_4)
geo_3 = Geometry(filter)
geo_4 = Geometry(bang_2.Branch6)
geo_5 = Geometry(bang.Branch4)
geo_6 = Geometry(bang_2.Branch4)
geo_7 = Geometry(bang.Branch6)
merge_5 = Merge(Data1=geo_6, Data2=geo_4, Data3=geo_7)  # -> flatten(Result)
ccx_2 = CurveCurve(CurveA=merge_5, CurveB=geo_5)  # -> Points, ParamsA, ParamsB
shatter = Shatter(Curve=geo_5, Parameters=flatten(ccx_2.ParamsB))
len = Length(Curve=shatter)
ma = MassAddition(Input=len)  # -> Result, PartialResults

# ----
# Node
number_slider_5 = Slider(2, range=0..5)

# ----
# Node
number_slider_6 = Slider(2, range=0..5)

# ----
# Node
number_slider_7 = Slider(1, range=0..1)

# ----
# Node
number_slider_8 = Slider(0, range=0..1)

# ----
# Node
number_slider_9 = Slider(0, range=0..1)

# ----
# Node
number_slider_10 = Slider(1, range=0..5)

# ----
# Curve
geo_8 = Geometry(bang.Branch4)

# ----
# Surface
geo_9 = Geometry(bang.Branch5)

# ----
# Curve
geo_10 = Geometry(bang.Branch6)

# ----
# Surface
geo_11 = Geometry(bang.Branch7)

# ----
# Surface
geo_12 = Geometry(bang.Branch5)

# ----
# Curve
geo_13 = Geometry(bang.Branch4)

# ----
# Curve
geo_14 = Geometry(bang_2.Branch4)

# ----
# Surface
geo_15 = Geometry(bang_2.Branch5)

# ----
# Curve
geo_16 = Geometry(bang.Branch4)

# ----
# Surface
geo_17 = Geometry(bang.Branch5)

# ----
# Curve
geo_18 = Geometry(bang_2.Branch4)

# ----
# Surface
geo_19 = Geometry(bang_2.Branch5)

item_2 = ListItem(List=ma.PartialResults, Index=expr("x+1", number_slider_9), Wrap=True)
item_3 = ListItem(List=len, Index=number_slider_9, Wrap=True)  # -> Item, Item1
item_4 = ListItem(List=ma.PartialResults, Index=number_slider_9, Wrap=True)
subtraction_2 = Subtraction(A=item_3.Item1, B=number_slider_2)
subtraction_3 = Subtraction(A=item_2, B=number_slider_2)
addition_4 = Addition(A=item_2, B=number_slider_2)
addition_5 = Addition(A=item_3.Item1, B=number_slider_2)

# ----
# Plane on straight
cluster_19 = Cluster_7(C=geo_16, L=item_4, S=geo_17, A=subtraction_2)  # -> C_2, C_3, G

# ----
# Plane on bent strip
cluster_20 = Cluster_5(C=geo_16, L=subtraction_3, S=geo_17)  # -> pl_2, i

# ----
# Interpolation
cluster_21 = Cluster_6(A=cluster_19.C_2, B=cluster_19.C_3, A_2=cluster_19.G, B_2=cluster_20.pl_2, L=subtraction_2)

# ----
# Nodes 3
flippln_13 = FlipPlane(Plane=cluster_21, FlipX=True, FlipY=False, FlipZ=False)  # -> Flipped, R
mirror = Mirror(Geometry=flippln_13.Flipped, Plane=yz)  # -> Geometry, Transform
target_7 = CreateTarget(Plane=mirror.Geometry, RobConf=8, IsCartesian=True)
item_5 = ListItem(List=mirror.Geometry, Index=0, Wrap=True)  # -> Item1, Item
target_8 = CreateTarget(Plane=flippln_13.Flipped, RobConf=8, IsCartesian=True)
item_6 = ListItem(List=flippln_13.Flipped, Index=0, Wrap=True)  # -> Item1, Item

# ----
# Pink
# Bend
# Grab
item_7 = ListItem(List=target_7, Index=0, Wrap=True)  # -> Item1, Item

# ----
# Blue
# Bend
# Grab
item_8 = ListItem(List=target_8, Index=0, Wrap=True)  # -> Item1, Item

# ----
# Robot 102
refresh = Button()

filter_2 = StreamFilter(Gate=Slider(1, range=0..12), Stream0=item_5.Item, Stream1=item_5.Item1)
geo_20 = Geometry(filter_2)

# ----
# Communication
refresh_text_window = Button()
# Steps
# init
# pp to main
# play
# robot on
# update_settings
# send
list = ValueList({"192.168.0.102", "192.168.0.103"}, selected="192.168.0.103")
update_settings = Button()
init = Button()
reset_robot = Button()
list_2 = ValueList({"tool 0": "0", "robotic_lacing_pneumatic": "1", "robotic_lacing_electric": "2"}, selected="robotic_lacing_pneumatic")
r_off = Button()
r_on = Button()
list_3 = ValueList({"robotic_lacing_wobj": 10}, selected="robotic_lacing_wobj")
send_planes = Button()
send_joints = Button()
list_4 = ValueList({"fast": 0, "mid": 1, "slow": 2}, selected="slow")
python = GhPythonScript(refresh=refresh, ip_abb=list, init=init)  # -> out, communication
# ---------- python: Python ----------
#from scriptcontext import sticky as st
from compas_rhino.utilities.misc import unload_modules
from compas_ghpython import unload_modules
from abb_communication.clients.rfl_robot.communication import ABBCommunication

if refresh:
    unload_modules("abb_communication")

communication = ABBCommunication("ABB", ip_abb, port_snd = 30003, port_rcv=30004)
# ---------- end python ----------
if_connection = PythonScript(
    init=init,
    communication=python.communication,
    ip_abb=list,
    connect_robot=r_on,
    close_robot=r_off,
    refresh=refresh_text_window,
    reset_robot=reset_robot)  # -> out, communication; inputs connect_robot: Boolean, close_robot: Boolean, refresh: Boolean
# ---------- if_connection: Python ----------
import Rhino.Geometry as rg
from compas.geometry import Frame
from abb_communication.geometry import Frame as F
from scriptcontext import sticky as st
from abb_communication.clients.rfl_robot.communication.messages.clientstates import *
from abb_communication.clients.rfl_robot.communication import ABBCommunication


#communication = ABBCommunication("ABB", ip_abb, port_snd = 30003, port_rcv=30004)
#st["communication"] = communication

#communication = st["communication"]

print communication.running

# =========================================================================================    
if connect_robot == True:
    if communication.running == False:
       communication.start()
    else:
        pass

# =========================================================================================    
if close_robot == True:
    if communication.running == True:
        communication.close()
        communication.cmd_counter_to_client = 0
        communication.cmd_exec_counter_from_client = 0
        
        communication.publish_state(1)
    else:
        pass

if reset_robot:
    communication.close()
    communication.cmd_counter_to_client = 0
    communication.cmd_exec_counter_from_client = 0
    communication.publish_state(1)
    try:
        communication.start()
    except:
        print "CONNECTION TO ABB FAILED"



robot_conncection_state = "online" if communication.running else "offline"
print "ABB CONNECTION STATE:", robot_conncection_state
print "ABB STATE: ", client_states_str_array[communication.state]
print "Sent commands to ABB: ",  communication.get_cmd_counter()
print "Executed commands from ABB: ",  communication.cmd_exec_counter_from_client
# ---------- end if_connection ----------
update_sender = PythonScript(
    init=init,
    communication=if_connection.communication,
    update_settings=update_settings,
    speed=list_4,
    tool_num=list_2,
    wobj_num=list_3,
    rob_num=Slider(1, range=0..10))  # -> out, a; inputs tool_num: Int32
# ---------- update_sender: Python ----------
from abb_communication.clients.rfl_robot.communication.messages.messagetypes import *
import Rhino.Geometry as rg
from abb_communication.geometry import Frame
from scriptcontext import sticky as st
import math as m
from threading import Thread
import time


#communication = st["communication"]
#print joints_abb
if communication:    
    
    communication.float_arbitrary = rob_num
    if update_settings:
        if speed == 0:
            print "SET SPEED FAST"
            communication.set_speed_fast()
        if speed == 1:
            print "SET SPEED MID"
            communication.set_speed_mid()
        if speed == 2:
            print "SET SPEED SLOW"
            communication.set_speed_slow()
        if tool_num:
            communication.set_tool_to_num(tool_num)
        else:
            print "Provide to tool number"
        """
        if tool_num == 0:
            print "SET TOOL 0"
            communication.set_tool0()
        elif tool_num == 1:
            print "SET TOOL MESH MOULD"
            communication.set_tool_meshmould()
        elif tool_num == 6:
            print "SET TOOL MTIP"
            communication.set_tool_mtip()
        elif tool_num == 7:
            print "SET TOOL LWS GRIPPER"
            communication.set_tool_lws_gripper()
        elif tool_num == 8:
            print "SET TOOL STU GRIPPER"
            communication.set_tool_stu_gripper()
        elif tool_num == 10:
            print "SET TOOL MAS MAGAZINE"
            communication.set_tool_mas_magazine()
        else:
            print "WRONG TOOL NUM"
        """
        if wobj_num:
            communication.set_wobj_to_num(wobj_num)
        else:
            print "Provide a WOBJ number"

        """
        if wobj_num == 0:
            print "SET WOBJ 0"
            communication.set_wobj_0()
        elif wobj_num == 1:
            print "SET WOBJ LWS COMMON"
            communication.set_wobj_common()
        elif wobj_num == 2:
            print "SET WOBJ BASE"
            communication.set_wobj_base()
        elif wobj_num == 3:
            print "SET WOBJ STU PICK"
            communication.set_wobj_stu_pick()
        elif wobj_num == 4:
            print "SET WOBJ STU BASE"
            communication.set_wobj_stu_base()
        else:
            print "WRONG TOOL NUM"
           """
        if wobj_num:
            communication.set_rob_num(rob_num)
        else:
            print "Provide a WOBJ number"
    # =========================================================================================
    # =========================================================================================
    if communication.running:
        print "ROBOT IS ONLINE"
        # =====================================================================================     
    else:
        print "ROBOT IS OFFLINE"
# ---------- end update_sender ----------
testsend = GhPythonScript(communication=if_connection.communication, planes=geo_20, send_joints=send_joints, send_planes=send_planes)  # -> out, a; inputs joints: list, planes: list
# ---------- testsend: Python ----------
from abb_communication.clients.rfl_robot.communication.messages.messagetypes import *
import Rhino.Geometry as rg
from compas.geometry import Frame as fr
from abb_communication.geometry import Frame
from scriptcontext import sticky as st
import math as m
from threading import Thread
import time

ext_axes = [0,0,0]
#list_planes_length = len(planes)

#print joints_abb
if communication:        
    if communication.running:
        print "ROBOT IS ONLINE"
        if send_joints:
            joints_abb = joints + [0,0,0]
            joints_abb_list = [float(x) for x in joints_abb]
            print joints_abb
            communication.send_axes_absolute(joints_abb_list, int_arr = None)
        if send_planes:
            if len(planes) == 1:
                communication.send_pose_cartesian(planes[0])
            else:
                communication.send_pose_cartesian_list(planes)
    else:
        print "ROBOT IS OFFLINE"
# ---------- end testsend ----------
panel_3 = Panel(if_connection.out)
panel_4 = Panel(testsend.out)
panel_5 = Panel(update_sender.out)

# ----
# Gripper
button = Button()
python_2 = GhPythonScript(communication=if_connection.communication, open_gripper=button, close_gripper=Button())  # -> out, a
# ---------- python_2: Python ----------
from abb_communication.clients.rfl_robot.communication.messages.messagetypes import *

if open_gripper: 
    communication.send_open_gripper()
    
if close_gripper: 
    communication.send_close_gripper()
# ---------- end python_2 ----------
panel_6 = Panel(python_2.out)

panel_7 = Panel(python.out)
data = Data(python.communication)
toggle_gripper = Button()
send_planes_2 = Button()
get_pose = Button()
unwind = Button()
panel_8 = Panel(data)
refresh_2 = Button()
retract = Button()
fake_multimove = Button()
python_3 = GhPythonScript(communication=data, refresh=refresh_2, toggle_gripper=toggle_gripper, get_pose=get_pose, retract=retract, unwind=unwind)  # -> out, current_pose
# ---------- python_3: Python ----------
import robotic_lacing.tasks as robotic_lacing
from compas_rhino.utilities.misc import unload_modules
from compas_ghpython import unload_modules

if refresh:
    unload_modules("robotic_lacing")
    
rl = robotic_lacing.robotic_lacing(communication)

if communication:
    
    #print(communication)
    
    current_pose = rl.get_pose_as_plane(communication)

    if toggle_gripper:
        rl.toggle_gripper(communication)
        #rl.open_gripper(communication)
        #rl.close_gripper(communication)

    if retract:
        rl.retract(communication)

    if unwind:
        rl.unwind(communication)
            
else:
    print("No communication")
# ---------- end python_3 ----------
python_4 = GhPythonScript(refresh=refresh_2, communication=data, planes=geo_20, send=send_planes_2)  # -> out, a; inputs planes: list of Plane
# ---------- python_4: Python ----------
import robotic_lacing.tasks as rl
from compas_rhino.utilities.misc import unload_modules
from compas_ghpython import unload_modules

if refresh:
    unload_modules("robotic_lacing")

if communication.running:
    print("communication is running")

if send:
    rl.send_planes(communication, planes)
# ---------- end python_4 ----------
refresh_3 = Button()
panel_9 = Panel(python_3.out)
# Robot 103
refresh_4 = Button()

filter_3 = StreamFilter(Gate=Slider(1, range=0..15), Stream0=item_6.Item, Stream1=item_6.Item1)
geo_21 = Geometry(filter_3)

# ----
# Communication
refresh_text_window_2 = Button()
list_5 = ValueList({"192.168.0.102", "192.168.0.103"}, selected="192.168.0.103")
init_2 = Button()
reset_robot_2 = Button()
list_6 = ValueList({"tool 0": "0", "robotic_lacing_pneumatic": "1", "robotic_lacing_electric": "2"}, selected="robotic_lacing_pneumatic")
r_off_2 = Button()
r_on_2 = Button()
list_7 = ValueList({"robotic_lacing_wobj": 10}, selected="robotic_lacing_wobj")
update_settings_2 = Button()
send_planes_3 = Button()
send_joints_2 = Button()
list_8 = ValueList({"fast": 0, "mid": 1, "slow": 2}, selected="slow")
python_5 = GhPythonScript(refresh=refresh_4, ip_abb=list_5, init=init_2)  # -> out, communication; same code as python
if_connection_2 = PythonScript(
    init=init_2,
    communication=python_5.communication,
    ip_abb=list_5,
    connect_robot=r_on_2,
    close_robot=r_off_2,
    refresh=refresh_text_window_2,
    reset_robot=reset_robot_2)  # -> out, communication; inputs connect_robot: Boolean, close_robot: Boolean, refresh: Boolean; same code as if_connection
update_sender_2 = PythonScript(
    init=init_2,
    communication=if_connection_2.communication,
    update_settings=update_settings_2,
    speed=list_8,
    tool_num=list_6,
    wobj_num=list_7,
    rob_num=Slider(1, range=0..10))  # -> out, a; inputs tool_num: Int32; same code as update_sender
testsend_2 = GhPythonScript(communication=if_connection_2.communication, planes=geo_21, send_joints=send_joints_2, send_planes=send_planes_3)  # -> out, a; inputs joints: list, planes: list
# ---------- testsend_2: Python ----------
from abb_communication.clients.rfl_robot.communication.messages.messagetypes import *
import Rhino.Geometry as rg
from compas.geometry import Frame as fr
from abb_communication.geometry import Frame
from scriptcontext import sticky as st
import math as m
from threading import Thread
import time

ext_axes = [0,0,0]
list_planes_length = len(planes)

#print joints_abb
if communication:        
    if communication.running:
        print "ROBOT IS ONLINE"
        if send_joints:
            joints_abb = joints + [0,0,0]
            joints_abb_list = [float(x) for x in joints_abb]
            print joints_abb
            communication.send_axes_absolute(joints_abb_list, int_arr = None)
        if send_planes:
            if len(planes) == 1:
                communication.send_pose_cartesian(planes[0])
            else:
                communication.send_pose_cartesian_list(planes)
    else:
        print "ROBOT IS OFFLINE"
# ---------- end testsend_2 ----------
panel_10 = Panel(if_connection_2.out)
# we had to unwind joint 4 at step 4 for the blue robot
# init
# pp to main
# play
# robot on
# set speed, tool, wobj
# set speed on controller
# send movement
panel_11 = Panel(testsend_2.out)
panel_12 = Panel(update_sender_2.out)

data_2 = Data(if_connection_2.communication)
python_6 = GhPythonScript(refresh=refresh_3, communication_a=data, communication_b=data_2, move_rel_tool_both=fake_multimove)  # -> out, a
# ---------- python_6: Python ----------
import robotic_lacing.tasks as rl
from compas_rhino.utilities.misc import unload_modules
from compas_ghpython import unload_modules

if refresh:
    unload_modules("robotic_lacing")

if communication_a.running:
    print("communication A is running")

if communication_b.running:
    print("communication B is running")

if move_rel_tool_both:
    rl.retract(communication_a)
    rl.retract(communication_b)
# ---------- end python_6 ----------

# ----
# Gripper
button_2 = Button()
python_7 = GhPythonScript(communication=if_connection_2.communication, open_gripper=button_2, close_gripper=Button())  # -> out, a; same code as python_2
panel_13 = Panel(python_7.out)

python_8 = GhPythonScript(ip_abb=list_5, init=init_2)  # -> out, communication
# ---------- python_8: Python ----------
from scriptcontext import sticky as st
from abb_communication.clients.rfl_robot.communication import ABBCommunication

communication = ABBCommunication("ABB", ip_abb, port_snd = 30003, port_rcv=30004)
#st["communication"] = communication
# ---------- end python_8 ----------

subtraction_4 = Subtraction(A=item_2, B=number_slider_2)

# ----
# Plane on bent strip
cluster_22 = Cluster_5(C=geo_16, L=subtraction_4, S=geo_17)  # -> pl_2, i

flippln_14 = FlipPlane(Plane=cluster_22.pl_2, FlipX=True, FlipY=False, FlipZ=False)  # -> Flipped, R

# ----
# (1) Blue
# Grab
target_9 = CreateTarget(Plane=flippln_14.Flipped, IsCartesian=True)

item_9 = ListItem(List=ma.PartialResults, Index=expr("x+1", number_slider_6), Wrap=True)
item_10 = ListItem(List=len, Index=number_slider_6, Wrap=True)  # -> Item, Item1
item_11 = ListItem(List=ma.PartialResults, Index=number_slider_6, Wrap=True)
addition_6 = Addition(A=item_10.Item1, B=number_slider_2)
addition_7 = Addition(A=item_9, B=number_slider_2)

# ----
# Plane on straight
cluster_23 = Cluster_7(C=geo_8, L=item_11, S=geo_9, A=addition_6)  # -> C_2, C_3, G

# ----
# Plane on bent strip
cluster_24 = Cluster_5(C=geo_8, L=addition_7, S=geo_9)  # -> pl_2, i

# ----
# Interpolation
cluster_25 = Cluster_6(A=cluster_23.C_2, B=cluster_23.C_3, A_2=cluster_23.G, B_2=cluster_24.pl_2, L=addition_6)

flippln_15 = FlipPlane(Plane=cluster_25, FlipX=True, FlipY=False, FlipZ=False)  # -> Flipped, R
mirror_2 = Mirror(Geometry=flippln_15.Flipped, Plane=yz)  # -> Geometry, Transform

# ----
# Blue
# Bend
target_10 = CreateTarget(Plane=flippln_15.Flipped, IsCartesian=True)

# ----
# Pink
# Bend
target_11 = CreateTarget(Plane=mirror_2.Geometry, IsCartesian=True)

item_12 = ListItem(List=ma.PartialResults, Index=expr("x+1", number_slider_5), Wrap=True)
item_13 = ListItem(List=len, Index=number_slider_5, Wrap=True)  # -> Item, Item1
item_14 = ListItem(List=ma.PartialResults, Index=number_slider_5, Wrap=True)
addition_8 = Addition(A=item_13.Item1, B=number_slider_2)
addition_9 = Addition(A=item_12, B=number_slider_2)

# ----
# Plane on straight
cluster_26 = Cluster_7(C=geo_10, L=item_14, S=geo_11, A=addition_8)  # -> C_2, C_3, G

# ----
# Plane on bent strip
cluster_27 = Cluster_5(C=geo_10, L=addition_9, S=geo_11)  # -> pl_2, i

# ----
# Interpolation
cluster_28 = Cluster_6(A=cluster_26.C_2, B=cluster_26.C_3, A_2=cluster_26.G, B_2=cluster_27.pl_2, L=addition_8)

mirror_3 = Mirror(Geometry=cluster_28, Plane=yz)  # -> Geometry, Transform

# ----
# Node 7
# Nodes 7 and 8
# Node 8
# Node 8
# Node 7
item_15 = ListItem(List=cluster_28, Index=0, Wrap=True)
item_16 = ListItem(List=mirror_3.Geometry, Index=0, Wrap=True)
item_17 = ListItem(List=mirror_2.Geometry, Index=0, Wrap=True)
item_18 = ListItem(List=flippln_15.Flipped, Index=0, Wrap=True)

# ----
# Blue
# Grab
target_12 = CreateTarget(Plane=item_18, IsCartesian=True)

# ----
# Pink
# Grab
target_13 = CreateTarget(Plane=item_15, IsCartesian=True)

# ----
# Blue
# Grab
target_14 = CreateTarget(Plane=item_16, IsCartesian=True)

# ----
# Pink
# Grab
target_15 = CreateTarget(Plane=item_17, IsCartesian=True)

# ----
# Pink
# Bend
target_16 = CreateTarget(Plane=cluster_28, IsCartesian=True)

# ----
# Blue
# Bend
target_17 = CreateTarget(Plane=mirror_3.Geometry, IsCartesian=True)

item_19 = ListItem(List=ma.PartialResults, Index=expr("x+1", number_slider_7), Wrap=True)
item_20 = ListItem(List=len, Index=number_slider_7, Wrap=True)  # -> Item, Item1
item_21 = ListItem(List=ma.PartialResults, Index=number_slider_7, Wrap=True)
addition_10 = Addition(A=item_20.Item1, B=number_slider_2)
addition_11 = Addition(A=item_19, B=number_slider_2)

# ----
# Plane on straight
cluster_29 = Cluster_7(C=geo_13, L=item_21, S=geo_12, A=addition_10)  # -> C_2, C_3, G

# ----
# Plane on bent strip
cluster_30 = Cluster_5(C=geo_13, L=addition_11, S=geo_12)  # -> pl_2, i

# ----
# Interpolation
cluster_31 = Cluster_6(A=cluster_29.C_2, B=cluster_29.C_3, A_2=cluster_29.G, B_2=cluster_30.pl_2, L=addition_10)

mirror_4 = Mirror(Geometry=cluster_31, Plane=yz)  # -> Geometry, Transform

# ----
# Node 4
# Pink
# Bend
target_18 = CreateTarget(Plane=cluster_31, IsCartesian=True)

# ----
# Blue
# Bend
# Node 5
target_19 = CreateTarget(Plane=mirror_4.Geometry, RobConf=8, IsCartesian=True)

# ----
# Pink
# Grab
item_22 = ListItem(List=cluster_31, Index=0, Wrap=True)  # -> Item1, Item
item_23 = ListItem(List=target_18, Index=0, Wrap=True)  # -> Item1, Item

# ----
# Blue
# Grab
item_24 = ListItem(List=target_19, Index=0, Wrap=True)  # -> Item1, Item
item_25 = ListItem(List=mirror_4.Geometry, Index=0, Wrap=True)  # -> Item1, Item

item_26 = ListItem(List=ma.PartialResults, Index=expr("x+1", number_slider_8), Wrap=True)
item_27 = ListItem(List=len, Index=number_slider_8, Wrap=True)  # -> Item, Item1
item_28 = ListItem(List=ma.PartialResults, Index=number_slider_8, Wrap=True)
addition_12 = Addition(A=item_27.Item1, B=number_slider_2)
addition_13 = Addition(A=item_26, B=number_slider_2)

# ----
# Plane on straight
cluster_32 = Cluster_7(C=geo_14, L=item_28, S=geo_15, A=addition_12)  # -> C_2, C_3, G

# ----
# Plane on bent strip
cluster_33 = Cluster_5(C=geo_14, L=addition_13, S=geo_15)  # -> pl_2, i

# ----
# Interpolation
cluster_34 = Cluster_6(A=cluster_32.C_2, B=cluster_32.C_3, A_2=cluster_32.G, B_2=cluster_33.pl_2, L=addition_12)

flippln_16 = FlipPlane(Plane=cluster_34, FlipX=True, FlipY=False, FlipZ=False)  # -> Flipped, R
mirror_5 = Mirror(Geometry=flippln_16.Flipped, Plane=yz)  # -> Geometry, Transform

# ----
# Nodes 4 and 5
# Node 5
item_29 = ListItem(List=mirror_5.Geometry, Index=0, Wrap=True)

# ----
# Node 4
# Blue
# Bend
target_20 = CreateTarget(Plane=flippln_16.Flipped, IsCartesian=True)

# ----
# Pink
# Grab
target_21 = CreateTarget(Plane=item_29, IsCartesian=True)

# ----
# Blue
# Grab
item_30 = ListItem(List=flippln_16.Flipped, Index=0, Wrap=True)  # -> Item1, Item
item_31 = ListItem(List=target_20, Index=0, Wrap=True)  # -> Item1, Item

# ----
# Pink
# Bend
target_22 = CreateTarget(Plane=mirror_5.Geometry, IsCartesian=True)

item_32 = ListItem(List=ma.PartialResults, Index=expr("x+1", number_slider_10), Wrap=True)
item_33 = ListItem(List=len, Index=number_slider_10, Wrap=True)  # -> Item, Item1
item_34 = ListItem(List=ma.PartialResults, Index=number_slider_10, Wrap=True)
addition_14 = Addition(A=item_33.Item1, B=number_slider_2)
addition_15 = Addition(A=item_32, B=number_slider_2)

# ----
# Node 6
subtraction_5 = Subtraction(A=item_32, B=number_slider_2)
subtraction_6 = Subtraction(A=item_33.Item1, B=number_slider_2)

# ----
# Plane on straight
cluster_35 = Cluster_7(C=geo_18, L=item_34, S=geo_19, A=subtraction_6)  # -> C_2, C_3, G

# ----
# Plane on bent strip
cluster_36 = Cluster_5(C=geo_18, L=subtraction_5, S=geo_19)  # -> pl_2, i

# ----
# Interpolation
cluster_37 = Cluster_6(A=cluster_35.C_2, B=cluster_35.C_3, A_2=cluster_35.G, B_2=cluster_36.pl_2, L=subtraction_6)

mirror_6 = Mirror(Geometry=cluster_37, Plane=yz)  # -> Geometry, Transform

target_23 = CreateTarget(Plane=cluster_37, RobConf=8, IsCartesian=True)
target_24 = CreateTarget(Plane=mirror_6.Geometry, RobConf=8, IsCartesian=True)

# ----
# Pink
# Bend
# Grab
item_35 = ListItem(List=cluster_37, Index=0, Wrap=True)  # -> Item1, Item
item_36 = ListItem(List=target_23, Index=0, Wrap=True)  # -> Item1, Item

# ----
# Blue
# Bend
# Grab
item_37 = ListItem(List=mirror_6.Geometry, Index=0, Wrap=True)  # -> Item1, Item
item_38 = ListItem(List=target_24, Index=0, Wrap=True)  # -> Item1, Item

entwine_2 = Entwine(Branch01=item_36.Item, Branch02=item_36.Item1, FlattenInputs=True)  # -> flatten(Result)
entwine_3 = Entwine(Branch01=item_38.Item, Branch02=item_38.Item1, FlattenInputs=True)  # -> flatten(Result)
entwine_4 = Entwine(
    Branch00=item_23.Item,
    Branch01=target_18,
    Branch03=target_21,
    Branch04=target_22,
    Branch06=item_36.Item,
    Branch07=item_36.Item1,
    Branch09=target_13,
    Branch010=target_16,
    Branch012=target_15,
    Branch013=target_11,
    FlattenInputs=True)  # -> flatten(Result)
entwine_5 = Entwine(
    Branch00=target_9,
    Branch01=item_31.Item,
    Branch02=target_20,
    Branch04=item_24.Item,
    Branch05=target_19,
    Branch07=item_38.Item,
    Branch08=item_38.Item1,
    Branch09=target_12,
    Branch010=target_10,
    Branch011=target_14,
    Branch012=target_17,
    FlattenInputs=True)  # -> flatten(Result)

filter_4 = StreamFilter(
    Gate=Slider(5, range=0..12),
    Stream0=item_22.Item,
    Stream1=cluster_31,
    Stream2=item_29,
    Stream3=mirror_5.Geometry,
    Stream4=item_35.Item,
    Stream5=item_35.Item1,
    Stream6=item_15,
    Stream7=cluster_28,
    Stream8=item_17,
    Stream9=mirror_2.Geometry)
geo_22 = Geometry(filter_4)

filter_5 = StreamFilter(
    Gate=Slider(2, range=0..15),
    Stream0=flippln_14.Flipped,
    Stream1=item_30.Item,
    Stream2=flippln_16.Flipped,
    Stream3=item_25.Item,
    Stream4=mirror_4.Geometry,
    Stream5=item_37.Item,
    Stream6=item_37.Item1,
    Stream7=item_18,
    Stream8=flippln_15.Flipped,
    Stream9=item_16,
    Stream10=mirror_3.Geometry)
geo_23 = Geometry(filter_5)

# ==== cluster Cluster
L = ClusterInput()
item = ListItem(List=L, Index=0, Wrap=True)  # -> Item, Item1, Item2, Item3, Item4, Item5, Item6, Item7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
number_slider = Slider(5, range=0..10)
pt = ConstructPoint(XCoordinate=item.Item5, YCoordinate=item.Item6, ZCoordinate=item.Item7)
vec = VectorXYZ(XComponent=item.Item8, YComponent=item.Item9, ZComponent=item.Item10)  # -> Vector, Length
vec_2 = VectorXYZ(XComponent=item.Item11, YComponent=item.Item12, ZComponent=item.Item13)  # -> Vector, Length
vec_3 = VectorXYZ(XComponent=item.Item14, YComponent=item.Item15, ZComponent=item.Item16)  # -> Vector, Length
division = Division(A=item.Item1, B="200")
intcrv = Interpolate(Vertices=flatten(pt), Degree=3, Periodic=False, KnotStyle=1)  # -> Curve, Length, Domain
amp = Amplitude(Vector=vec_2.Vector, Amplitude=number_slider)
amp_2 = Amplitude(Vector=vec.Vector, Amplitude=number_slider)
line = LineSDL(Start=pt, Direction=vec.Vector, Length=number_slider)
line_2 = LineSDL(Start=pt, Direction=vec_2.Vector, Length=number_slider)
line_3 = LineSDL(Start=pt, Direction=vec_3.Vector, Length=number_slider)
amp_3 = Amplitude(Vector=vec_3.Vector, Amplitude=number_slider)
eval = EvaluateCurve(Curve=reparameterize(intcrv.Curve), Parameter=division)  # -> Point, Tangent, Angle
F = ClusterInput()
entwine = Entwine(Branch00=intcrv.Curve, Branch01=eval.Point, Branch02=line, Branch03=line_2, Branch04=line_3, FlattenInputs=True)
Z = UnitZ(Factor=F)
F_2 = ClusterInput()
item_2 = ListItem(List=eval.Point, Index=0, Wrap=True)  # -> Item1, Item
move = Move(Geometry=entwine, Motion=Z)  # -> Geometry, Transform
X = UnitX(Factor=F_2)  # -> expr("-x", UnitVector)
rotate = Rotate(Geometry=entwine, Angle=3.141592654, Plane=PlaneXY(0, 0, 0))  # -> Geometry, Transform
F_3 = ClusterInput()
move_2 = Move(Geometry=move.Geometry, Motion=X)  # -> Geometry, Transform
Y = UnitY(Factor=F_3)
move_3 = Move(Geometry=move_2.Geometry, Motion=Y)  # -> Geometry, Transform
bang = ExplodeTree(Data=move_3.Geometry)  # -> Branch0, Branch1, Branch2, Branch3, Branch4
crv = Curve(bang.Branch0)
pt_2 = Point(bang.Branch1)
vec_4 = Vector(bang.Branch2)
vec_5 = Vector(bang.Branch4)
vec_6 = Vector(bang.Branch3)
pt_3 = ClusterOutput(pt_2)
crv_2 = ClusterOutput(crv)
vec_7 = ClusterOutput(vec_4)
vec_8 = ClusterOutput(vec_6)
vec_9 = ClusterOutput(vec_5)

# ==== cluster Cluster_2
number_slider = Slider(5, range=0..10)
S = ClusterInput()
D = ClusterInput()
neg = Negative(Value=number_slider)
line = LineSDL(Start=S, Direction=D, Length=graft([number_slider, neg]))  # -> flatten(Line)
intcrv = Interpolate(Vertices=S, Degree=3, Periodic=False, KnotStyle=1)  # -> Curve, Length, Domain
join = JoinCurves(Curves=line, Preserve=False)
item = ListItem(List=D, Index=0, Wrap=True)  # -> Item1, Item
ext = ExtendCurve(Curve=intcrv.Curve, Type=0, Start=Slider(150, range=0..1000), End=Slider(300, range=0..1000))
item_2 = ListItem(List=join, Index=0, Wrap=True)
end = EndPoints(Curve=ext)  # -> Start, End
line_2 = LineSDL(Start=end.End, Direction=item.Item1, Length=[number_slider, neg])  # -> flatten(Line)
line_3 = LineSDL(Start=end.Start, Direction=item.Item, Length=[number_slider, neg])  # -> flatten(Line)
join_2 = JoinCurves(Curves=line_2, Preserve=False)
join_3 = JoinCurves(Curves=line_3, Preserve=False)
ins = InsertItems(List=join, Item=join_2, Indices="-1", Wrap=True)
ins_2 = InsertItems(List=ins, Item=join_3, Indices="0", Wrap=True)
swp1 = Sweep1(Rail=ext, Sections=ins_2, Miter=1)
S_2 = ClusterOutput(swp1)
C = ClusterOutput(ext)

# ==== cluster Cluster_3
crv = ClusterInput()
L = ClusterInput()
L_2 = ClusterInput()
crv_2 = Curve(crv)
L_3 = ClusterInput()
number_slider = Slider(5, range=0..10)
end = EndPoints(Curve=crv_2)  # -> Start, End
item = ListItem(List=L_2, Index=0, Wrap=True)
item_2 = ListItem(List=L, Index=0, Wrap=True)
rev = Reverse(Vector=item_2)
neg = Negative(Value=number_slider)
line = LineSDL(Start=end.Start, Direction=rev, Length=L_3)
ext = ExtendCurve(Curve=line, Type=0, Start=Slider(400, range=0..1000), End=0)
end_2 = EndPoints(Curve=ext)  # -> Start, End
line_2 = LineSDL(Start=end_2.Start, Direction=item, Length=[neg, number_slider])
join = JoinCurves(Curves=line_2, Preserve=False)
swp1 = Sweep1(Rail=ext, Sections=join, Miter=1)
crv_3 = Curve(ext)
flip = FlipCurve(Curve=crv_3)  # -> Curve, Flag
S = ClusterOutput(swp1)
C = ClusterOutput(flip.Curve)

# ==== cluster Cluster_4
B = ClusterInput()
A = ClusterInput()
range = Range(Domain=Domain(0, 1), Steps=Slider(10, range=0..10))
crv = Curve(B)
crv_2 = Curve(A)
twn2crvs = TweenTwoCurves(CurveA=A, CurveB=B, Factor=range, Refit=0, PointSample=0)
item = ListItem(List=twn2crvs, Index=0, Wrap=True)
len = Length(Curve=item)
len_2 = Length(Curve=twn2crvs)
subtraction = Subtraction(A=len, B=len_2)
ext = ExtendCurve(Curve=twn2crvs, Type=0, Start="0", End=subtraction)
end = EndPoints(Curve=ext)  # -> Start, End
intcrv = Interpolate(Vertices=end.End, Degree=3, Periodic=False, KnotStyle=1)  # -> Curve, Length, Domain
A_2 = ClusterInput()
B_2 = ClusterInput()
twn2plnscrv = TweenTwoPlanesOnCurve(PlaneA=A_2, PlaneB=B_2, Curve=intcrv.Curve, Factor=range, Weighted=False, Quaternion=True)
T = ClusterOutput(twn2plnscrv)

# ==== cluster Cluster_5
C = ClusterInput()
L = ClusterInput()
S = ClusterInput()
eval = EvaluateLength(Curve=C, Length=L, Normalized=False)  # -> Point, Tangent, Parameter
shatter = Shatter(Curve=C, Parameters=eval.Parameter)
srf_cp = SurfaceClosestPoint(Point=eval.Point, Surface=S)  # -> Point, UVPoint, Distance
item = ListItem(List=shatter, Index=1, Wrap=True)
evalsrf = EvaluateSurface(Surface=S, Point=srf_cp.UVPoint)  # -> Point, Normal, UDirection, VDirection, Frame
explode = Explode(Curve=item, Recursive=True)  # -> Segments, Vertices
pl = ConstructPlane(Origin=evalsrf.Point, XAxis=evalsrf.VDirection, YAxis=evalsrf.UDirection)
item_2 = ListItem(List=explode.Segments, Index=0, Wrap=True)
i = ClusterOutput(item_2)
pl_2 = ClusterOutput(pl)

# ==== cluster Cluster_6
A = ClusterInput()
B = ClusterInput()
range = Range(Domain=Domain(0, 1), Steps=10)
L = ClusterInput()
tweencrv = TweenCurve(CurveA=A, CurveB=B, Factor=range, BlendType=0)
eval = EvaluateLength(Curve=tweencrv, Length=L, Normalized=False)  # -> Point, Tangent, Parameter
intcrv = Interpolate(Vertices=eval.Point, Degree=3, Periodic=False, KnotStyle=1)  # -> Curve, Length, Domain
B_2 = ClusterInput()
A_2 = ClusterInput()
twn2plnscrv = TweenTwoPlanesOnCurve(PlaneA=A_2, PlaneB=B_2, Curve=intcrv.Curve, Factor=range, Weighted=False, Quaternion=True)
T = ClusterOutput(twn2plnscrv)

# ==== cluster Cluster_7
C = ClusterInput()
A = ClusterInput()
L = ClusterInput()
S = ClusterInput()
eval = EvaluateLength(Curve=C, Length=L, Normalized=False)  # -> Point, Tangent, Parameter
shatter = Shatter(Curve=C, Parameters=eval.Parameter)
srf_cp = SurfaceClosestPoint(Point=eval.Point, Surface=S)  # -> Point, UVPoint, Distance
item = ListItem(List=shatter, Index=1, Wrap=True)
evalsrf = EvaluateSurface(Surface=S, Point=srf_cp.UVPoint)  # -> Point, Normal, UDirection, VDirection, Frame
explode = Explode(Curve=item, Recursive=True)  # -> Segments, Vertices
pl = ConstructPlane(Origin=evalsrf.Point, XAxis=evalsrf.VDirection, YAxis=evalsrf.UDirection)
item_2 = ListItem(List=explode.Segments, Index=0, Wrap=True)
len = Length(Curve=item_2)
eval_2 = EvaluateLength(Curve=C, Length=L, Normalized=False)  # -> Point, Tangent, Parameter
ext = ExtendCurve(Curve=item_2, Type=0, Start=0, End=len)
line = LineSDL(Start=eval_2.Point, Direction=eval_2.Tangent, Length=len)
ext_2 = ExtendCurve(Curve=line, Type=0, Start=0, End=len)
amp = Amplitude(Vector=line, Amplitude=A)
C_2 = ClusterOutput(ext_2)
C_3 = ClusterOutput(ext)
move = Move(Geometry=pl, Motion=amp)  # -> Geometry, Transform
G = ClusterOutput(move.Geometry)
